# Grasshopper definition final debug(second example)- 3.gh (Grasshopper 1.0.7)
# plug-ins: Kiwi3d, Kangaroo2 Components

panel = Panel("""1
0
4""")
panel_2 = Panel("""0
2
2
3""")
panel_3 = Panel("""0
3""")
panel_4 = Panel("""2
0
3""")
panel_5 = Panel("""0
3""")
panel_6 = Panel("""north
east""")
panel_7 = Panel("""south
east""")
panel_8 = Panel("""3
0""")
# مضرب block hight and width
# Tedad Vahed dar har tabaghe
panel_9 = Panel("180")
panel_10 = Panel("""25
25
20""")
panel_11 = Panel("""1
0
2""")
panel_12 = Panel("""0
2
3
3""")
panel_13 = Panel("""0
1""")
panel_14 = Panel("""25
25
25
20""")
panel_15 = Panel("""25
25""")
panel_16 = Panel("""25
25""")
panel_17 = Panel("""1
0
2""")
panel_18 = Panel("""0
1""")
panel_19 = Panel("""25
25
20""")
mesh = Mesh([<mesh referenced from the Rhino model> x3])
mesh_2 = Mesh([<mesh referenced from the Rhino model> x4])
mesh_3 = Mesh([<mesh referenced from the Rhino model> x2])
mesh_4 = Mesh([<mesh referenced from the Rhino model> x2])
mesh_5 = Mesh([<mesh referenced from the Rhino model> x3])
# Tedad Vahed dar har tabaghe
number_slider = Slider(50, range=0..100)
number_slider_2 = Slider(5, range=0..10)
number_slider_3 = Slider(5, range=0..10)
number_slider_4 = Slider(3, range=0..10)
sort = SortList(Keys=panel_8)  # -> Keys, ValuesA
entwine = Entwine(Branch00="west", Branch01=panel_6, Branch02=panel_7, Branch03="south", FlattenInputs=True)
area = Area(Geometry=mesh_3)  # -> Area, Centroid
rad = Radians(Degrees=number_slider)
brep = Brep(<brep referenced from the Rhino model>)  # disabled
clean = CleanTree(RemoveNulls=True, RemoveInvalid=True, RemoveEmpty=True, Tree=entwine)
points = PointList(Points=area.Centroid, Size=Slider(1.5, range=0..10))
c_script = CSharpScript(
    BlockWidth=Slider(5, range=0..10),
    BlockLength=Slider(5, range=0..100),
    BlockHight=Slider(4, range=0..10),
    HouseWidth=number_slider_3,
    HouseLength=number_slider_2,
    HouseHight=number_slider_4,
    Vertical_Connection="2,2",
    iEnteranceDelete=Toggle(False),
    iDeleteIndex=sort.Keys,
    iBrep=brep)  # -> out, OGrids, OVertical, OEnterance, UNWantedPts, OVerticalAccessBrep; inputs BlockWidth: Int32, BlockLength: Int32, BlockHight: Int32, HouseWidth: Int32, HouseLength: Int32, HouseHight: Int32, Vertical_Connection: list of String, iEnteranceDelete: Boolean, iDeleteIndex: list of Int32, iBrep: Brep
# ---------- c_script: C# usings ----------
using Rhino.Collections;
using System.Linq;
# ---------- c_script: C# ----------
    var Grid_1 = new Grid_2(BlockWidth, HouseWidth, BlockLength, HouseLength, HouseHight, Vertical_Connection);
    var GridList = new List<List<Point3d>>();
    var verticalList = new List<List<Point3d>>();
    var EnteranceList = new List<Point3dList>();

    for(int i = 0; i < BlockHight;i++)
    {
      verticalList.Add(Grid_1.VerticalAccess(i));
      GridList.Add(Grid_1.Construct_Grid_2D(i));
      if(iEnteranceDelete)
      {
        EnteranceList.Add(Grid_1.EnterancePts(i, iDeleteIndex));
      }
      else
      {
        EnteranceList.Add(Grid_1.EnterancePts(i));
      }
    }
    //flatten
    var vertflatten = Flatten(verticalList);



    //OutputMaking
    var GridTree = new DataTree<Point3d>();
    for(var i = 0; i < GridList.Count;i++)
    {
      for(var j = 0; j < GridList[i].Count; j++)
      {
        GridTree.Add(GridList[i][j], new GH_Path(i));
      }
    }
    var flattengrid = Flatten(GridList);
    var EnteranceTree = new DataTree<Point3d>();
    for(var i = 0; i < EnteranceList.Count; i++)
      for(var j = 0; j < EnteranceList[i].Count; j++)
        EnteranceTree.Add(EnteranceList[i][j], new GH_Path(i));


    if (iBrep != null)
    {
      var unwanted = CheckPointINBrep(flattengrid, iBrep, 0.1);
      for (int i = 0 ; i < vertflatten.Count;i++)
      { var temp = CheckPointINBrep(vertflatten, iBrep, 0.1);
        if ( temp.Count != 0)
        {
          throw new ArgumentOutOfRangeException("vertical", "unwanted points contain vertical");
        }
      }
      //OUTPUT
      UNWantedPts = unwanted;
    }

    else
    {
      Print("Brep for unwanted points not set");
    }


    var brep = Grid_1.MakeVerticalConnection(vertflatten);

    //OUTPUTS
    OEnterance = EnteranceTree;
    OGrids = GridTree;
    OVertical = vertflatten;
    OVerticalAccessBrep = brep;
# ---------- c_script: C# additional code ----------
  /// <summary>
  /// removing unwanted points in a brep
  /// </summary>
  /// <param name="ptlist">grid points</param>
  /// <param name="brp">brep</param>
  /// <param name="tel">tolerance</param>
  /// <returns></returns>
  public static List<Point3d> CheckPointINBrep(List<Point3d> ptlist, Brep brp, double tel)
  { var unwantedpts = new List<Point3d>();
    for(int i = 0 ;i < ptlist.Count;i++)
    {
      if (brp.IsPointInside(ptlist[i], tel, false))
      {
        unwantedpts.Add(ptlist[i]);
      }
    }
    return unwantedpts;
  }
  /// <summary>
  /// flatten a list<lis<point3d>
  /// </summary>
  /// <param name="list">list you want to flatten</param>
  /// <returns>list(point3d)</returns>
  public static List<Point3d> Flatten(List<List<Point3d>> list)
  {var listflatten = new List<Point3d>();
    for(int i = 0 ; i < list.Count; i++)
    {
      for (int j = 0 ; j < list[i].Count;j++)
      {
        listflatten.Add(list[i][j]);
      }
    }
    return listflatten;
  }

  /// <summary>
  /// check if two points have same xy
  /// </summary>
  /// <param name="a"></param>
  /// <param name="b"></param>
  /// <returns> distance between the 2 points</returns>
  public static double DistanceBetweenPoints (Point3d a, Point3d b)
  {
    var dx = a.X - b.X;
    var dy = a.Y - b.Y;
    var distance = Math.Sqrt(dx * dx + dy * dy);
    return distance;
  }
  /// <summary>
  /// gets the position of vertical connection
  /// </summary>
  /// <param name="str">string consists of x,y</param>
  /// <returns>converted string to integer list</returns>
  public static int[] GetString(string str, int len)
  {  if(String.IsNullOrWhiteSpace(str))
    {
      throw new ArgumentNullException("input string", "input srting is null or whitespace");
    }
    if(str.Length != 3 || str[1] != ',')
    {
      throw new ArgumentOutOfRangeException("string", "input string format is not correct . it should be int,int without space");
    }


    var arrayint = new int[len];
    var temp = str.Split(',');
    for( int i = 0 ; i < temp.Length ;i++)
    {
      try
      {
        int p = int.Parse(temp[i]);
        arrayint[i] = p;
      }
      catch
      {
        throw new ArgumentOutOfRangeException("input string", "string inputs are not convertable to integers.");
      }
    }
    return arrayint;
  }

  /// <summary>
  /// basic class that handels all grid creating functions
  /// </summary>
  public class Grid_2
  {
    //variables fromoutside
    public int BlockWidth { get; set; }
    public double HouseWidth { get; set; }
    public int BlockLength { get; set; }
    public double HouseLength { get; set; }
    public double HouseHight { get; set; }
    public int ZAxis { get; set; }
    public List<string> Vertical_Connection {get;set;}
    /// <summary>
    /// constructor for building the grid
    /// </summary>
    /// <param name="BlockWidth">the x length of the block</param>
    /// <param name="HouseWidth">the x length of the house</param>
    /// <param name="BlockLength">the y length of the block</param>
    /// <param name="HouseLength">the y length of the house</param>
    /// <param name="HouseHight">the z length of house</param>
    /// <param name="verticalConnection">the position of the vertical access/s</param>
    public Grid_2(int BlockWidth, int HouseWidth, int BlockLength, int HouseLength, int HouseHight, List<string> verticalConnection)
    {

      if (BlockWidth <= 0 || HouseWidth <= 0 || BlockLength <= 0 || HouseLength <= 0 || HouseHight <= 0)
      {
        throw new ArgumentOutOfRangeException("dimentions", "dimentions should be greater than zero");
      }

      if( BlockWidth < HouseWidth || BlockLength < HouseLength)
      {
        throw new ArgumentOutOfRangeException("dimentions", "block dimentions are lower than house dimentions");
      }


      this.BlockWidth = BlockWidth;
      this.HouseWidth = HouseWidth;
      this.BlockLength = BlockLength;
      this.HouseLength = HouseLength;
      this.HouseHight = HouseHight;
      this.Vertical_Connection = verticalConnection;

    }



    /// <summary>
    ///creates the main grid without the vertical access
    /// </summary>
    /// <param name="ZAxis">the floor number</param>
    /// <returns>The grid 2d</returns>
    public List<Point3d> Construct_Grid_2D(int ZAxis)
    {

      List<Point3d> pt = VerticalAccess(ZAxis);
      var PTGrid2D = new List<Point3d>();

      for (double i = 0; i < BlockWidth * HouseWidth; i += HouseWidth)
      {
        for (double j = 0; j < BlockLength * HouseLength; j += HouseLength)
        {
          Point3d Pt_Temp = new Point3d(i, j, (ZAxis * HouseHight));
          PTGrid2D.Add(Pt_Temp);
        }
      }
      for(int i = 0 ;i < pt.Count;i++)
      {
        int temp = PTGrid2D.IndexOf(pt[i]);
        PTGrid2D.RemoveAt(temp);
      }
      return PTGrid2D;
    }
    /// <summary>
    /// gets the enterance points in each floor
    /// </summary>
    /// <param name="ZAxis">the floor</param>
    /// <param name="str"></param>
    /// <returns></returns>

    public Point3dList EnterancePts(int ZAxis)
    {
      var EnterancePTs = new Point3dList();
      var verticalaccess = VerticalAccess(ZAxis);
      foreach ( var temp in verticalaccess)
      {
        for (int i = -1; i < 2; i++)
        {
          for (int j = -1; j < 2; j++)
          {
            if(Math.Abs(i) == Math.Abs(j))
            {
              continue;
            }
            var pttemp = new Point3d(temp.X + i * HouseWidth, temp.Y + j * HouseLength, temp.Z);
            if(pttemp.X >= 0 && pttemp.X <= (BlockWidth-1) * HouseWidth && pttemp.Y >= 0 && pttemp.Y <= (BlockLength-1) * HouseLength)
            { var boolpt = true;
              for (int k = 0;k < verticalaccess.Count;k++)
              {
                if (DistanceBetweenPoints(verticalaccess[k], pttemp) < 0.1)
                {
                  boolpt = false;
                }

              }
              if(boolpt)
              {
                EnterancePTs.Add(pttemp);
              }
            }
          }
        }
      }
      return EnterancePTs;
    }

    /// <summary>
    /// an overload taking indexes to delete the unwanted enterance points
    /// </summary>
    /// <param name="ZAxis">the floor</param>
    /// <param name="deleteindex">indexes you want to remove</param>
    /// <returns>enterance points</returns>
    public Point3dList EnterancePts(int ZAxis, List<int> deleteindex)
    {
      for(int i = 0 ; i < deleteindex.Count;i++)
      {
        if( deleteindex[i] < 0 || deleteindex[i] > 3)
        {
          throw new ArgumentOutOfRangeException("deleteindex", "invalid index: index can only be 0,1,2,3");
        }
      }
      var verticalaccess = VerticalAccess(ZAxis);
      var EnterancePTs = new Point3dList();
      foreach ( var temp in verticalaccess)
      {
        for (int i = -1; i < 2; i++)
        {
          for (int j = -1; j < 2; j++)
          {
            if(Math.Abs(i) == Math.Abs(j))
            {
              continue;
            }
            var pttemp = new Point3d(temp.X + i * HouseWidth, temp.Y + j * HouseLength, temp.Z);
            if(pttemp.X >= 0 && pttemp.X <= (BlockWidth-1) * HouseWidth && pttemp.Y >= 0 && pttemp.Y <= (BlockLength-1) * HouseLength)
            {
              var boolpt = true;
              for (int k = 0;k < verticalaccess.Count;k++)
              {
                if (DistanceBetweenPoints(verticalaccess[k], pttemp) < 0.1)
                {
                  boolpt = false;
                }

              }
              if(boolpt )
              {
                EnterancePTs.Add(pttemp);
              }

            }
          }
        }
      }
      for(int i = deleteindex.Count - 1 ;i >= 0;i--)
      {
        EnterancePTs.RemoveAt(deleteindex[i]);
      }

      return EnterancePTs;
    }
    /// <summary>
    /// creats vertical access points
    /// </summary>
    /// <param name="ZAxis">the floor</param>
    /// <param name="str"></param>
    /// <returns></returns>
    public List<Point3d> VerticalAccess(int ZAxis)
    { var ptl = new List<Point3d>();
      foreach ( var str in Vertical_Connection)
      {
        var temp = GetString(str, 2);
        Point3d pt = new Point3d(temp[0] * HouseWidth, temp[1] * HouseLength, ZAxis * HouseHight);
        ptl.Add(pt);
      }
      return ptl;
    }

    public List<Box> MakeVerticalConnection(List<Point3d> vertpts)
    { var BoxList = new List<Box>();
      var intervalx = new Interval(-1 * (HouseWidth / 2), HouseWidth / 2);
      var intervaly = new Interval(-1 * (HouseLength / 2), HouseLength / 2);
      var intervalz = new Interval(-1 * (HouseHight / 2), HouseHight / 2);
      for(int i = 0; i < vertpts.Count;i++)
      {
        var PlaneOrigin = new Plane(vertpts[i], Vector3d.ZAxis);
        //varPlaneList.Add(PlaneOrigin);
        var box = new Box(PlaneOrigin, intervalx, intervaly, intervalz);
        BoxList.Add(box);
      }
      return BoxList;

    }



  }
# ---------- end c_script ----------

# ----
# Types
# Lights
# Areas
# Rotation
number_slider_5 = Slider(1.5, range=0..10)
area_2 = Area(Geometry=mesh_5)  # -> Area, Centroid
rad_2 = Radians(Degrees="90")
rad_3 = Radians(Degrees=panel_9)
points_2 = PointList(Points=area_2.Centroid, Size=number_slider_5)

entwine_2 = Entwine(Branch00=rad, Branch01=Slider(12, range=0..100), FlattenInputs=True)  # -> flatten(Result)
area_3 = Area(Geometry=mesh)  # -> Area, Centroid
rad_4 = Radians(Degrees=panel_9)
rad_5 = Radians(Degrees=panel_9)
# Types
# Lights
# Areas
# Rotation
# mahramiat
rad_6 = Radians(Degrees=panel_9)

# ---- group: light condition component
c_script_2 = CSharpScript(iConditions=clean)  # -> out, LightConditions; inputs iConditions: tree of String
# ---------- c_script_2: C# ----------
    var ListTemp = new List<string>();
    var Conditions = new List<List<string>>();
//    var ListLight_1 = GetLightFaces(one);
//    ListTemp.Add(ListLight_1);
//    var ListLight_2 = GetLightFaces(two);
//    ListTemp.Add(ListLight_2);
//    var ListLight_3 = GetLightFaces(three);
//    ListTemp.Add(ListLight_3);
    
    for(var i = 0; i < iConditions.BranchCount;i++)
    { var temp = new List<string>();
      for(var j = 0; j < iConditions.Branches[i].Count;j++)
      {
        temp.Add( iConditions.Branches[i][j]);
      }
      Conditions.Add(temp);
    }

    foreach(var con in Conditions)
    {
      var temp =GetLightFaces(con);
      ListTemp.Add(temp);
    }

    LightConditions = ListTemp;
# ---------- c_script_2: C# additional code ----------
  public string GetLightFaces(List<string> inputstr)
  {
    var List_Light = new List<int>();
    foreach(var temp in inputstr)
    {
      switch(temp)
      {
        case ("south"):
        {
          List_Light.Add(1);
          break;
        }
        case ("east"):
        {
          List_Light.Add(2);
          break;
        }
        case ("north"):
        {
          List_Light.Add(3);
          break;
        }
        case  ("west"):
        {
          List_Light.Add(4);
          break;
        }
        case ("top"):
        {
          List_Light.Add(5);
          break;
        }
        default:
        {
          throw new ArgumentOutOfRangeException("conditions", "inputs can only take north,south,west,east , are you sure you typed them right?");
        }


      }
    }
    string result = string.Join(",", List_Light);
    return result;


  }
# ---------- end c_script_2 ----------
panel_20 = Panel(c_script_2.out)

# ----
points_3 = PointList(Points=area_3.Centroid, Size=Slider(1.5, range=0..10))

entwine_3 = Entwine(Branch00=panel_19, Branch01=panel_10, Branch02=panel_14, Branch03=panel_15, FlattenInputs=True)
entwine_4 = Entwine(Branch00=rad_2, Branch01=rad_3, Branch02=rad_4, Branch03=rad_5, FlattenInputs=True)
entwine_5 = Entwine(Branch00=panel_17, Branch01=panel_11, Branch02=panel_12, Branch03=panel_13, FlattenInputs=True)
entwine_6 = Entwine(Branch00=panel_4, Branch01=panel, Branch02=panel_2, Branch03=panel_3, FlattenInputs=True)
entwine_7 = Entwine(Branch00=mesh_5, Branch01=mesh, Branch02=mesh_2, Branch03=mesh_3, FlattenInputs=True)
pt = Point(c_script.OGrids)
pt_2 = Point(c_script.OVertical)
pt_3 = Point(c_script.OEnterance)
pt_4 = Point(c_script.UNWantedPts)
brep_2 = Brep(c_script.OVerticalAccessBrep)

panel_21 = Panel("""4
3
3
3
1
1""")
srf = Surface([<surface referenced from the Rhino model> x4])
brep_3 = Brep(<brep referenced from the Rhino model>)

sunion = SolidUnion(Breps=brep_2)
clean_2 = CleanTree(RemoveNulls=True, RemoveInvalid=True, RemoveEmpty=True, Tree=entwine_7)
clean_3 = CleanTree(RemoveNulls=True, RemoveInvalid=True, RemoveEmpty=True, Tree=entwine_5)
clean_4 = CleanTree(RemoveNulls=True, RemoveInvalid=True, RemoveEmpty=True, Tree=entwine_6)
clean_5 = CleanTree(RemoveNulls=True, RemoveInvalid=True, RemoveEmpty=True, Tree=entwine_3)
clean_6 = CleanTree(RemoveNulls=True, RemoveInvalid=True, RemoveEmpty=True, Tree=entwine_4)
panel_22 = Panel(c_script.out)
panel_23 = Panel(c_script_2.LightConditions)
entwine_8 = Entwine(Branch00=sunion, Branch01=brep_3, FlattenInputs=True)  # -> flatten(Result)
number_slider_6 = Slider(0, range=0..100)
panel_24 = Panel(c_script.OEnterance)
flatten = FlattenTree(Tree=c_script.OGrids, Path="{0}")

c_script_3 = CSharpScript(
    iGrid=flatten,
    iVertical=c_script.OVertical,
    iEnterance=c_script.OEnterance,
    UnWantedPts=c_script.UNWantedPts,
    meshes=clean_2,
    types=clean_3,
    lights=clean_4,
    areas=clean_5,
    rotations=clean_6,
    VahedCount=panel_21,
    iFloors=Slider(1, range=0..10),
    LightSurfaces=srf,
    AdittionalBreps=entwine_8,
    LightConditions=c_script_2.LightConditions,
    iAccuracy=Slider(5, range=0..10),
    LightButton=Toggle(True),
    PrivecyButton=Toggle(True),
    PrivecyOptions=entwine_2,
    rotationButton=Toggle(False),
    Step="0,100",
    reset=Toggle(True))  # -> out, OMeshes, OModulesCount, OAlternativesCount, D, OWinFacePlane, OMeshCenters, OGetTypes, OVerticalConnection, Test; inputs iGrid: list of Point3d, iVertical: list of Point3d, iEnterance: tree of Point3d, UnWantedPts: list of Point3d, meshes: tree of Mesh, types: tree of Int32, lights: tree of Int32, areas: tree of Int32, rotations: tree of Double, VahedCount: list of Int32, iFloors: Int32, LightSurfaces: list of Surface, AdittionalBreps: list of Brep, LightConditions: list of String, iAccuracy: Int32, LightButton: Boolean, PrivecyButton: Boolean, PrivecyOptions: list of Double, rotationButton: Boolean, Step: String, reset: Boolean
# ---------- c_script_3: C# usings ----------
using Rhino.Collections;
using System.Linq;
using Rhino.Geometry.Intersect;
# ---------- c_script_3: C# ----------
    ///////creating lightsurfaces normals
    var normallist = new List<Vector3d>();
    foreach ( var n in LightSurfaces)
    {
      normallist.Add(n.NormalAt(0.5, 0.5));
    }

    //////creating the 3d Grid
    //var Grid_1 = new Grid_2(BlockWidth, HouseWidth, BlockLenght, HouseLenght, HouseHight, Vertical_Connection_x, Vertical_Connection_y);
    var GridList = iGrid;
    var verticalList = iVertical;
    var EnteranceList = new List<List<Point3d>>();
    for(var i = 0; i < iEnterance.BranchCount;i++)
    { var temp = new List<Point3d>();
      for(var j = 0; j < iEnterance.Branches[i].Count;j++)
      {
        if(iEnterance.Branches[i][j] == null)
        {
          throw new ArgumentNullException("entrance points", "null detected");
        }
        temp.Add(iEnterance.Branches[i][j]);
      }
      EnteranceList.Add(temp);
    }
    var PointCheck = UnWantedPts;
    var FinaleList = new List<AllHouses>();

    //adding vertical to the unwanted
    for (int i = 0; i < verticalList.Count; i++)
    {
      if(verticalList[i] == null)
      {
        throw new ArgumentNullException("verticalList", "null detected ");
      }
      PointCheck.Add(verticalList[i]);
    }
    OVerticalConnection = verticalList[0];


    //////adding data for meshes
    var houses = new List<House>();
    var ALLHouses = new List<House>();
    for(var i = 0; i < meshes.BranchCount;i++)
    {
      var house = new House();
      for(var j = 0; j < meshes.Branches[i].Count; j++)
      {
        house.Add(types.Branches[i][j], lights.Branches[i][j], areas.Branches[i][j], meshes.Branches[i][j]);

      }
      house.AddConnectedFace();
      houses.Add(house);

    }
    Print(houses.Count.ToString());



    if (reset == true)
    {



      if (rotationButton == true)
      {
        //adding rotation data
        for(var i = 0; i < rotations.BranchCount;i++)
        { var temp = new List<double>();
          for(var j = 0; j < rotations.Branches[i].Count; j++)
          {

            if( rotations.Branches[i][j] != 0)
            {
              temp.Add(rotations.Branches[i][j]);
            }
          }
          houses[i].RotationAdd(temp);
        }
        ///// adding rotation options
        var temphouses = new List<House>();
        foreach(var h in houses)
        {
          foreach (var r in h.Rotations)
          {
            if(h.Rotations.Count != 0)
            {
              var temph = new House();
              var RotationAxis = Vector3d.ZAxis;
              var RotationCenter = h.GetEnteranceCenter();
              for(int k = 0; k < h.GetMeshes().Count;k++)
              {
                var copymesh = h.GetMeshes()[k].Duplicate();
                var c = copymesh.Rotate(r, RotationAxis, RotationCenter);
                temph.Add(h.GetTypes()[k], h.GetLights()[k], h.GetAreas()[k], (Mesh) copymesh);

              }
              temphouses.Add(temph);
            }
          }
        }
        foreach(var r in temphouses)
        {
          houses.Add(r);
        }
      }




      //////creating the permutation list for the meshes
      var TempNumbers = GenLoop.GetHouseNumbersForPermutation(houses);
      /////////////////////////////////////
      var MLoop = new Tabaghatloop(iAccuracy, AdittionalBreps, EnteranceList, houses,
        LightButton, LightConditions, LightSurfaces, normallist,
        PrivecyButton, PrivecyOptions, TempNumbers, PointCheck);
      ///////////////////////////////////////////////////////////////////////////


      for (int i = 0 ; i < iFloors ;i++)
      {
        RhinoApp.WriteLine("items created count = " + FinaleList.Count.ToString());
        FinaleList = MLoop.Tabaghat(VahedCount[i], i, FinaleList);
      }



      ////////////////OUTPUT/////////////////////////
      ////////////////////////////////////////////////
      ////////////////OUTPUT/////////////////////////
      var FinaleSpeed = new List<AllHouses>();
      if(FinaleList.Count == 0 )
      {
        throw new ArgumentOutOfRangeException("FinaleList", "no alternative was possible");
      }

      var steps = Generals.GetString(Step);
      if(FinaleList.Count > steps[1])
      {
        for(int i = steps[0] ;i < steps[1];i++)
        {
          FinaleSpeed.Add(FinaleList[i]);
        }
      }
      else
      {
        FinaleSpeed = FinaleList;
      }



      var OutPuttree = new DataTree<Mesh>();
      var OutPuttree5 = new DataTree<int>();
      for(int i = 0; i < FinaleSpeed.Count;i++)
      {
        for(int j = 0 ; j < FinaleSpeed[i].Tabaghat.Count ; j++)
        {
          for(int k = 0 ; k < FinaleSpeed[i].Tabaghat[j].Count;k++)
          {

            for(int l = 0 ;l < FinaleSpeed[i].Tabaghat[j][k].GetMeshes().Count;l++)
            {

              OutPuttree.Add(FinaleSpeed[i].Tabaghat[j][k].GetMeshes()[l], new GH_Path(i));
              OutPuttree5.Add(FinaleSpeed[i].Tabaghat[j][k].GetTypes()[l], new GH_Path(i));
            }

          }

        }
      }
      //////////////////////
      var OutPuttree2 = new DataTree<int>();
      for(int i = 0; i < FinaleSpeed.Count;i++)
      {
        for(int j = 0 ; j < FinaleSpeed[i].Tabaghat.Count ; j++)
        {
          for(int k = 0 ; k < FinaleSpeed[i].Tabaghat[j].Count;k++)
          {

            OutPuttree2.Add(FinaleSpeed[i].Tabaghat[j][k].GetMeshes().Count, new GH_Path(i));


          }

        }
      }

      var OutPuttree4 = new DataTree<Plane>();
      for(int i = 0; i < FinaleSpeed.Count;i++)
      {
        for(int j = 0 ; j < FinaleSpeed[i].Tabaghat.Count ; j++)
        {
          for(int k = 0 ; k < FinaleSpeed[i].Tabaghat[j].Count;k++)
          {
            for(int l = 0 ; l < FinaleSpeed[i].Tabaghat[j][k].Each_House.Count; l++)
            {

              OutPuttree4.Add(FinaleSpeed[i].Tabaghat[j][k].Each_House[l].WinFacePlane, new GH_Path(i));


            }

          }

        }
      }
      var OutPuttreepoints = new DataTree<Point3d>();
      for(int i = 0; i < FinaleSpeed.Count;i++)
      {
        for(int j = 0 ; j < FinaleSpeed[i].pointcheck.Count ; j++)
        {
          OutPuttreepoints.Add(FinaleSpeed[i].pointcheck[j], new GH_Path(i));

        }
      }





      OMeshes = OutPuttree;
      OModulesCount = OutPuttree2;
      OAlternativesCount = FinaleList.Count;
      //D = OutPuttree3;
      OWinFacePlane = OutPuttree4;
      OMeshCenters = OutPuttreepoints;
      OGetTypes = OutPuttree5;


    }
# ---------- c_script_3: C# additional code ----------
  ///////////////////////////////////////////////
  ///////GENERAL functions
  //////////////////////////////////////////////
  public static class Generals
  {
    /// <summary>
    /// creats a deep copy of a list of points
    /// </summary>
    /// <param name="list">list of points</param>
    /// <returns>deep copy</returns>
    public static List<int> CopyListOfPoints(List<int> list)
    {
      List<int> Copy = new List<int>();
      for(int i = 0;i < list.Count;i++)
      {
        Copy.Add(list[i]);
      }
      return Copy;
    }
    /// <summary>
    /// removing unwanted points in a brep
    /// </summary>
    /// <param name="ptlist">grid points</param>
    /// <param name="brp">brep</param>
    /// <param name="tel">tolerance</param>
    /// <returns></returns>
    public static List<Point3d> CheckPointINBrep(List<Point3d> ptlist, Brep brp, double tel)
    {
      if(!brp.IsValid)
      {
        throw new ArgumentNullException("brep", "brep is not valid");
      }
      if(ptlist.Count == 0)
      {
        throw new ArgumentNullException("Point list", "The list is empty");
      }
      var unwantedpts = new List<Point3d>();
      for (int i = 0; i < ptlist.Count; i++)
      {
        if (brp.IsPointInside(ptlist[i], tel, false))
        {
          unwantedpts.Add(ptlist[i]);
        }
      }
      return unwantedpts;
    }

    /// <summary>
    /// finds the avarage point between a list of points
    /// </summary>
    /// <param name="pts">list of points</param>
    /// <returns></returns>
    public static Point3d AvaragePointCalculator(List<Point3d> pts)
    {
      if(pts.Count == 0)
      {
        RhinoApp.WriteLine("the avaragecalculator only recieved one point");
      }
      var sum = new Point3d(0, 0, 0);
      for (int i = 0; i < pts.Count; i++)
      {
        sum += pts[i];
      }
      return sum / (pts.Count);
    }
    /// <summary>
    ///
    /// </summary>
    /// <param name="k1"></param>
    /// <param name="k2"></param>
    /// <param name="accuracy"></param>
    /// <returns></returns>
    public static double CaclulateSegments(Point3d k1, Point3d k2, int accuracy)
    {   if(accuracy == 1)
      {
        RhinoApp.WriteLine("beware that no division will happen");
      }
      if(accuracy <= 0)
      {
        throw new ArgumentOutOfRangeException("accuracy", "accuracy must be geater than 0 otherwise zero division or othe exceptions might happen");
      }
      if(!k1.IsValid || !k2.IsValid)
      {
        throw new ArgumentNullException("point", "unvalid point was given");
      }
      var temp = DistanceBetweenPoints(k2, k1) / accuracy;
      return temp;
    }

    /// <summary>
    /// calculates the 2d(xy plane) distance between points
    /// </summary>
    /// <param name="a"></param>
    /// <param name="b"></param>
    /// <returns></returns>
    public static double DistanceBetweenPoints2D(Point3d a, Point3d b)
    {
      if( !a.IsValid || !b.IsValid)
      {
        throw new ArgumentNullException("invalid point detected");
      }
      var dx = a.X - b.X;
      var dy = a.Y - b.Y;
      //var dz = a.Z - b.Z;
      // calculate the distance
      var distance = Math.Sqrt(dx * dx + dy * dy);
      return distance;
    }
    /// <summary>
    /// calculate the distance between 2 points
    /// </summary>
    /// <param name="a">first point</param>
    /// <param name="b">second point</param>
    /// <returns>the distance</returns>
    public static double DistanceBetweenPoints(Point3d a, Point3d b)
    {   if(!a.IsValid || !b.IsValid)
      {
        throw new ArgumentNullException("point", "unvalid point was given");
      }
      var dx = a.X - b.X;
      var dy = a.Y - b.Y;
      var dz = a.Z - b.Z;
      // calculate the distance
      var distance = Math.Sqrt(dx * dx + dy * dy + dz * dz);
      return distance;
    }
    /// <summary>
    /// move a point with a vector
    /// </summary>
    /// <param name="vec">the vector</param>
    /// <param name="pts">the point</param>
    /// <returns>moved point</returns>
    public static List<Point3d> AddPointWithVector(Vector3d vec, List<Point3d> pts)
    {
      if(!vec.IsValid )
      {
        throw new ArgumentNullException("vector", "given vector was not valid");
      }
      if(vec.IsZero)
      {
        throw new ArgumentException("the vector is zero !");
      }
      if(pts.Count == 0)
      {
        throw new ArgumentException("list of points is empty");
      }
      var ListCheck = new List<Point3d>();
      foreach (var pt in pts)
      {
        var temp = pt + vec;
        ListCheck.Add(temp);
      }
      return ListCheck;
    }
    /// <summary>
    /// checks if there are any duplicates in a list of points
    /// </summary>
    /// <param name="ptsToCheck">first list</param>
    /// <param name="CheckList">second list</param>
    /// <returns></returns>
    public static bool CheckForDuplicatePoints(List<Point3d> ptsToCheck, List<Point3d> CheckList)
    {
      var templist = new List<bool>();
      for (int i = 0;i < ptsToCheck.Count;i++)
      {
        for(int j = 0;j < CheckList.Count;j++)
        {
          if (DistanceBetweenPoints(ptsToCheck[i], CheckList[j]) < 0.2)
          {
            templist.Add(false);
          }
        }
      }

      if (templist.Count == 0)
      {
        return true;
      }
      else
      {
        return false;
      }
    }

    /// <summary>
    /// remove points that have same x and y (change the main list)
    /// </summary>
    /// <param name="pts">list of points</param>
    /// <returns> corrected list </returns>
    public static List<Point3d> RemoveDuplicate2D(List<Point3d> pts)
    {
      for (int i = 0; i < pts.Count; i++)
      {
        for (int j = pts.Count - 1; j > i; j--)
        {
          if (Generals.DistanceBetweenPoints2D(pts[i], pts[j]) < 0.1)
          {
            pts.RemoveAt(j);
          }
        }
      }
      return pts;
    }

    /// <summary>
    /// gets the permutation of a list for example for (1,2,3) --> (1,1),(1,2),(1,3),(2,1),(2,2),(2,3),(3,1),(3,2),(3,3)
    /// </summary>
    /// <param name="list">list of objects</param>
    /// <param name="length">number of objects in each permutation</param>
    /// <returns>all permutations</returns>
    private static IEnumerable<IEnumerable<int>> GetPermutationsWithRept(IEnumerable<int> list, int length)
    {
      if (length == 1)
      {
        return list.Select(t => new int[] { t });
      }
      return GetPermutationsWithRept(list, length - 1)
        .SelectMany(t => list,
        (t1, t2) => t1.Concat(new int[] { t2 }));
    }
    /// <summary>
    /// gets the permutation of a list without repetition for example for (1,2,3) --> (1,2),(1,3),(2,1),(2,3),(3,1),(3,2)
    /// </summary>
    /// <param name="list">list of objects</param>
    /// <param name="length">number of objects in each permutation</param>
    /// <returns></returns>
    private static IEnumerable<IEnumerable<int>>GetPermutations(IEnumerable<int> list, int length)
    {
      if (length == 1) return list.Select(t => new int[] { t });
      return GetPermutations(list, length - 1)
        .SelectMany(t => list.Where(o => !t.Contains(o)),
        (t1, t2) => t1.Concat(new int[] { t2 }));
    }
    /// <summary>
    /// gets combinations for example for (1,2,3) --> (1,1),(1,2),(1,3),(2,2),(2,3),(3,3)
    /// </summary>
    /// <param name="list">list of objects</param>
    /// <param name="length">number of objects in each combination</param>
    /// <returns>combinations</returns>
    private static IEnumerable<IEnumerable<int>> GetKCombsWithRept(IEnumerable<int> list, int length)
    {
      if (length == 1) return list.Select(t => new int[] { t });
      {
        return GetKCombsWithRept(list, length - 1).SelectMany(t => list.Where(o => o.CompareTo(t.Last()) >= 0),
          (t1, t2) => t1.Concat(new int[] { t2 }));
      }
    }
    /// <summary>
    /// gets permutation or combination and converts IEnumerations to list
    /// </summary>
    /// <param name="input">raw list</param>
    /// <param name="len">length of each part</param>
    /// <param name="perorcomb">"Combination" or "Permutation"</param>
    /// <returns></returns>
    public static List<List<int>> PermutationToList(List<int> input, int len, string perorcomb)
    {
      var tempnahayee = new List<List<int>>();
      try
      {


        IEnumerable<IEnumerable<int>> temp;
        if (perorcomb == "Permutation")
        {
          temp = GetPermutations(input, len);
        }
        else if (perorcomb == "Combination")
        {
          temp = GetKCombsWithRept(input, len);
        }
        else
        {
          throw new ArgumentOutOfRangeException("perorcomb", "input can only be Permutation or Combination");
        }

        var tempToList = temp.ToList();

        for (int i = 0; i < tempToList.Count; i++)
        {
          tempnahayee.Add(tempToList[i].ToList());
        }
      }
      catch(Exception)
      {
        RhinoApp.WriteLine("problem with PermutationToList function");
      }
      return tempnahayee;
    }
    /// <summary>
    /// checks if a point is in a list of points
    /// </summary>
    /// <param name="pt">the point</param>
    /// <param name="inputlist">the list to check</param>
    /// <returns>true if the point is not in the list</returns>
    public static bool CheckDupPoinInList(Point3d pt, List<Point3d> inputlist, double tolerance= 0.1)
    {
      if(!pt.IsValid)
      {
        throw new ArgumentNullException("point", "given point is not valid");
      }
      if(inputlist.Count == 0)
      {
        return true;
      }
      foreach (var ptcheck in inputlist)
      {
        if (DistanceBetweenPoints(pt, ptcheck) < tolerance)
        {
          return false;
        }
      }
      return true;
    }
    /// <summary>
    /// from a list checks if points are on the list of surfaces
    /// </summary>
    /// <param name="inputpoints">array of intersection points</param>
    /// <param name="srfs">list of surfaces</param>
    /// <param name="tolerance">the tolerance of near points to surface</param>
    /// <returns>points that where on the surface</returns>
    public static List<Point3d> CheckToBeOnSurface(List<Point3d[]> inputpoints, List<Point3d> inputorigins, List<Surface> srfs, out List<Point3d> outputorigins, double tolerance = 0.5)
    {
      for (int i = 0;i < srfs.Count;i++)
      {
        if(!srfs[i].IsValid)
        {
          throw new ArgumentException("unvalid surface detected");
        }
      }
      var OutPutOringins = new List<Point3d>(); ;
      var OutPutList = new List<Point3d>();
      try
      {
        for (int i = 0; i < inputpoints.Count; i++)
        {
          for (int j = 0; j < inputpoints[i].Length; j++)
          {
            foreach (var srf in srfs)
            {
              double u;
              double v;
              var test = srf.ClosestPoint(inputpoints[i][j], out u, out v);
              var temppt = srf.PointAt(u, v);
              var dist = temppt.DistanceTo(inputpoints[i][j]);
              if (dist < tolerance)
              {
                OutPutList.Add(inputpoints[i][j]);
                OutPutOringins.Add(inputorigins[i]);
              }
            }

          }
        }
      }
      catch(Exception)
      {
        RhinoApp.WriteLine("problem with CheckToBeOnSurface function");
      }
      outputorigins = OutPutOringins;
      return OutPutList;

    }

    /// <summary>
    /// calculates the normal of a face
    /// </summary>
    /// <param name="corners">corners of the face</param>
    /// <returns>the normal</returns>
    internal static Vector3d CalculateNormalOfFace(List<Point3d> corners)
    {   for(int i = 0;i < corners.Count;i++)
      {
        if(!corners[i].IsValid)
        {
          throw new ArgumentNullException("corners", "invalid point detected");
        }
      }
      Vector3d a = corners[1] - corners[0];
      Vector3d b = corners[2] - corners[0];
      var result = Vector3d.CrossProduct(a, b);
      return result;
    }
    /// <summary>
    /// flatten a list of arrays
    /// </summary>
    /// <param name="arrays"></param>
    /// <returns>flattend list</returns>
    public static List<Point3d> FlattenArray(List<Point3d[]> arrays)
    {
      var list = new List<Point3d>();
      try
      {
        for (int i = 0; i < arrays.Count; i++)
        {
          foreach (var arry in arrays[i])
          {
            list.Add(arry);
          }
        }
      }
      catch(Exception)
      {
        RhinoApp.WriteLine("problem with FlattenArray function");
      }
      return list;
    }
    public static List<Point3d> Flatten(List<List<Point3d>> list)
    {
      var listflatten = new List<Point3d>();
      try
      {
        for (int i = 0; i < list.Count; i++)
        {
          for (int j = 0; j < list[i].Count; j++)
          {
            listflatten.Add(list[i][j]);
          }
        }
      }
      catch(Exception)
      {
        RhinoApp.WriteLine("problem with Flatten function ");
      }
      return listflatten;
    }
    /// <summary>
    /// gets a string with the format int,int,... and convert it to a list of integer
    /// </summary>
    /// <param name="str">input string</param>
    /// <param name="len">lenght of each output array</param>
    /// <returns>ineger array</returns>
    public static int[] GetString(string str)
    {  //making sure the input is correct
      if (String.IsNullOrWhiteSpace(str))
      {
        throw new ArgumentNullException("input string", "input srting is null or whitespace");
      }
      int[] arrayint = new int[0];
      try
      {
        int[] result = new int[1];
        int res;
        if (int.TryParse(str, out res))
        {
          result[0] = res;
          return result;
        }


        string[] temp = str.Split(',');
        arrayint = new int[temp.Length];

        for (int i = 0; i < temp.Length; i++)
        {
          try
          {
            int p = int.Parse(temp[i]);
            arrayint[i] = p;
          }
          catch
          {
            throw new ArgumentOutOfRangeException("input string", "string inputs are not convertable to integers.");
          }
        }
      }
      catch (InvalidCastException)
      {
        Console.WriteLine("wrong input string cast");
      }
      catch (Exception)
      {
        Console.WriteLine("wrong input string");
      }

      return arrayint;
    }
    /// <summary>
    /// checks if a number is in a list of numbers
    /// </summary>
    /// <param name="list">list of numbers</param>
    /// <param name="check">number to check</param>
    /// <returns>true if the number is not in the list</returns>
    public static bool CheckDupIntInList(List<int> list, int check)
    {

      for(int i = 0;i < list.Count;i++)
      {
        if(Math.Abs(check - list[i]) < 0.001)
        {
          return false;
        }
      }
      return true;
    }
  }


  /////////////////////////////////
  //////////General Light functions
  /////////////////////////////////
  public class GenLight
  {
    public int Accuracy { get; set; }
    public List<string> LightConditions { get; set; }
    public List<Vector3d> Normals { get; set; }
    public List<Surface> SurfaceList { get; set; }

    public GenLight(int accuracy, List<string> lightconditions, List<Vector3d> normals, List<Surface> surfacelist)
    {
      this.Accuracy = accuracy;
      this.LightConditions = lightconditions;
      this.Normals = normals;
      this.SurfaceList = surfacelist;
    }

    /// <summary>
    /// adds rays to a spaces of a list of Houses
    /// </summary>
    /// <param name="listhouse">House instances</param>
    /// <param name="Allmeshs">light blockers</param>
    public  void AddLightToListOfHouse(List<House> listhouse, List<Brep> Allmeshs)
    {
      try
      {
        for (int i = 0; i < listhouse.Count; i++)
        {
          AddLightToHouse(listhouse[i], Allmeshs);
        }
      }
      catch(Exception)
      {
        RhinoApp.WriteLine("a problem happened in AddLightToListOfHouse method ");
      }
    }
    /// <summary>
    /// adds rays to each Space of a House
    /// </summary>
    /// <param name="house">the House instance</param>
    /// <param name="Allmeshs">light blockers</param>
    public  void AddLightToHouse(House house, List<Brep> Allmeshs)
    {
      try
      {
        for (int i = 0; i < house.Each_House.Count; i++)
        {
          AddRayToSpace(house.Each_House[i], Allmeshs);
        }
      }
      catch
      {
        RhinoApp.WriteLine("a problem happened in AddLightToHouse method ");
      }
    }

    /// <summary>
    /// take the space and add the rays based on the lightconditions
    /// </summary>
    /// <param name="space">mesh of the space</param>
    /// <param name="Allmeshs">all meshes for light blockers</param>
    private void AddRayToSpace(Space space, List<Brep> Allmeshs)
    {
      try
      {
        foreach (var normal in Normals)
        {

          if (space.Light != 0)
          {
            var light = space.Light;
            // [light-1] because the zero is no light
            var Condition_1 = LightConditions[light - 1];
            int[] cond_1 = Generals.GetString(Condition_1);
            var checkconnectedfaces = space.ConnectedFaces;
            var count = 0;
            for (int i = 0; i < cond_1.Length; i++)
            {
              if (!Generals.CheckDupIntInList(checkconnectedfaces, cond_1[i]))
              {
                count++;
              }
            }
            if (count == cond_1.Length)
            {
              throw new ArgumentException(String.Format("light condition {0} for a space is set badly due to their adjacent connected spaces and will not give any true alternative", space.Light));
            }
            for (int i = 0; i < cond_1.Length; i++)
            {
              if (Generals.CheckDupIntInList(checkconnectedfaces, cond_1[i]))
              {
                AddRaysToFace(space, cond_1[i], normal, Allmeshs);
              }

            }

          }
        }
      }
      catch (Exception)
      {
        RhinoApp.WriteLine("a problem happened in AddRayToSpace method ");
      }
    }
    /// <summary>
    /// add rays to the a face based on its index
    /// </summary>
    /// <param name="mesh">mesh of the space</param>
    /// <param name="faceindex">index of the face based on FaceIndex enum</param>
    /// <param name="boundbx">bounding box of the mesh</param>
    /// <param name="raybase"></param>
    /// <param name="normal">normal of light</param>
    /// <param name="Allmeshs">all meshes for light blockers</param>

    private void AddRaysToFace(Space space, int faceindex, Vector3d normal, List<Brep> Allmeshs)
    {
      try
      {
        var mesh = space.mesh;
        Vector3d FaceNormal = Generals.CalculateNormalOfFace(GenRays.GetFaceCorners(faceindex, mesh));
        if (Vector3d.VectorAngle(FaceNormal, normal) < (Math.PI / 2) - 00.1)
        {

          List<Point3d> pts = GenRays.GetFaceLightPoints(Accuracy, faceindex, mesh);
          //here we calcullate the face rays
          List<Ray3d> rays = GenRays.FaceRays(pts, normal);
          List<Point3d> OriginRayPoints = new List<Point3d>();
          List<Point3d[]> intersection_with_Breps = GenRays.IntersectionRays(rays, Allmeshs, out OriginRayPoints);
          List<Point3d> FinalOriginPoints = new List<Point3d>();
          List<Point3d> GetPointsOnSurface = Generals.CheckToBeOnSurface(intersection_with_Breps, OriginRayPoints, SurfaceList, out FinalOriginPoints);
          Ray_Face TempRayFace = new Ray_Face(GetPointsOnSurface, FinalOriginPoints, GenRays.GetFaceCorners(faceindex, mesh), faceindex);
          //add rayfaces to the rayface property of space
          space.AddRayFaceFunction(TempRayFace, faceindex);
        }
      }
      catch(Exception)
      {
        RhinoApp.WriteLine("a problem happened in  AddRaysToFace method ");
      }

    }
  }
  /////////////////////////////////
  /////////Genrays class
  ////////////////////////////////
  public static class GenRays
  {

    /// <summary>
    /// calculate the ray intersection points
    /// </summary>
    /// <param name="rays">list of rays</param>
    /// <param name="breps">list of breps</param>
    /// <returns></returns>
    public static List<Point3d[]> IntersectionRays(List<Ray3d> rays, List<Brep> breps,out List<Point3d> originpoints,int maxreflection=3)
    {
      var Intersections = new List<Point3d[]>();
      var origins = new List<Point3d>();
      try
      {
        foreach (var ray in rays)
        {
          var temp = Intersection.RayShoot(ray, breps, maxreflection);
          if (temp != null)
          {
            Intersections.Add(temp);
            origins.Add(ray.Position);
          }
        }
      }
      catch(Exception)
      {
        RhinoApp.WriteLine("problem in IntersectionRays method found");
      }
      originpoints = origins;
      return Intersections;
    }
    /// <summary>
    /// creates list of ray3d objects
    /// </summary>
    /// <param name="pts">list of base points</param>
    /// <param name="normal">normal</param>
    /// <returns>list of Ray3d objects</returns>
    public static List<Ray3d> FaceRays(List<Point3d> pts, Vector3d normal)
    {
      if(!normal.IsValid || normal.IsZero)
      {
        throw new ArgumentNullException("normal", "normal vector is either zero or unvalid");
      }
      List<Ray3d> RayList = new List<Ray3d>();
      for (int i = 0; i < pts.Count; i++)
      {
        RayList.Add(new Ray3d(pts[i], normal));
      }
      return RayList;
    }

    /// <summary>
    /// gets all corners of the bounding box
    /// </summary>
    /// <returns>all 8 corners</returns>
    internal static Point3d[] GetAllCorners(Mesh mesh)
    {
      if(!mesh.IsValid )
      {
        throw new ArgumentNullException("mesh", "input mesh is invalid");
      }
      var bdBox = mesh.GetBoundingBox(false);
      return bdBox.GetCorners();
    }
    /// <summary>
    /// gets all face corners based on the number of Faceindex enum
    /// </summary>
    /// <param name="index"></param>
    /// <returns>4point corners</returns>
    public static List<Point3d> GetFaceCorners(int index, Mesh mesh)
    {
      var FaceCorners = new List<Point3d>();
      var Corners = GetAllCorners(mesh);

      switch ((FaceIndex) index)
      {
        case (FaceIndex.Face1):
        {
          FaceCorners.Add(Corners[0]);
          FaceCorners.Add(Corners[1]);
          FaceCorners.Add(Corners[4]);
          FaceCorners.Add(Corners[5]);
          break;
        }
        case (FaceIndex.Face2):
        {
          FaceCorners.Add(Corners[1]);
          FaceCorners.Add(Corners[2]);
          FaceCorners.Add(Corners[5]);
          FaceCorners.Add(Corners[6]);
          break;
        }
        case (FaceIndex.Face3):
        {
          FaceCorners.Add(Corners[2]);
          FaceCorners.Add(Corners[3]);
          FaceCorners.Add(Corners[6]);
          FaceCorners.Add(Corners[7]);
          break;
        }
        case (FaceIndex.Face4):
        {
          FaceCorners.Add(Corners[3]);
          FaceCorners.Add(Corners[0]);
          FaceCorners.Add(Corners[7]);
          FaceCorners.Add(Corners[4]);
          break;
        }
        case (FaceIndex.Face5):
        {
          FaceCorners.Add(Corners[4]);
          FaceCorners.Add(Corners[5]);
          FaceCorners.Add(Corners[7]);
          FaceCorners.Add(Corners[6]);
          break;
        }
        case (FaceIndex.Face6):
        {
          FaceCorners.Add(Corners[1]);
          FaceCorners.Add(Corners[0]);
          FaceCorners.Add(Corners[2]);
          FaceCorners.Add(Corners[3]);
          break;
        }

        default:
        {
          throw new ArgumentOutOfRangeException("index", "index can only be from FaceIndex Enum numbers");
        }
      }

      return FaceCorners;

    }
    /// <summary>
    /// calculate all the light points of a face
    /// </summary>
    /// <param name="Accuracy">number of light points (x*x)</param>
    /// <param name="face">index of the face</param>
    /// <returns></returns>
    public static List<Point3d> GetFaceLightPoints(int Accuracy, int face, Mesh mesh)
    {
      var FacePoints = new List<Point3d>();
      var FaceCorners = GetFaceCorners(face, mesh);
      try
      {
        var SegmentAmountxy = Generals.CaclulateSegments(FaceCorners[0], FaceCorners[1], Accuracy);
        var SegmentAmountz = Generals.CaclulateSegments(FaceCorners[0], FaceCorners[2], Accuracy);
        //creating xy vectors
        Vector3d vectorxy = (FaceCorners[1] - FaceCorners[0]);
        vectorxy.Unitize();
        vectorxy *= SegmentAmountxy;
        //creating z vectors
        Vector3d vectorz = (FaceCorners[2] - FaceCorners[0]);
        vectorz.Unitize();
        vectorz *= SegmentAmountz;

        for (int i = 1; i < Accuracy; i++)
        {
          for (int j = 1; j < Accuracy; j++)
          {
            var tempvec = i * vectorxy + j * vectorz;
            var temppoint = FaceCorners[0] + tempvec;
            FacePoints.Add(temppoint);

          }
        }
      }
      catch(Exception)
      {
        RhinoApp.WriteLine("problem with the GetFaceLightPoints method");
      }
      return FacePoints;

    }


  }
  /////////////////////////////////////////
  ///////////////Space class
  /////////////////////////////////////////
  public class Space
  {
    //variables needed for each house
    public int Type { get; private set; }
    public int Light { get; private set; }
    public double Area { get; private set; }
    public Mesh mesh { get; private set; }
    /// <summary>
    /// ray face objects of each face
    /// </summary>
    public Ray_Face[] rayfaces { get; set; }
    /// <summary>
    /// face index that is recieving light
    /// </summary>
    public int lightface { get; set; }
    /// <summary>
    /// plane of the lightface
    /// </summary>
    public Plane WinFacePlane { get; set; }
    /// <summary>
    /// indexes of faces conectiong to other spaces of the same House object
    /// </summary>
    public List<int> ConnectedFaces { get; set; }
    public Space(int type, int light, double area, Mesh mesh)
    {
      if (area <= 0)
      {
        throw new ArgumentOutOfRangeException("area", "areas should be non negative and greater than 0");
      }
      if (!mesh.IsValid)
      {
        throw new ArgumentNullException("mesh", "input mesh is invalid");
      }
      this.Type = type;
      this.Light = light;
      this.Area = area;
      this.mesh = mesh;
      this.rayfaces = new Ray_Face[6];
      this.ConnectedFaces = new List<int>();

    }

    public void AddConnectedFace(int index)
    {
      ConnectedFaces.Add(index);
    }
    /// <summary>
    /// add a RayFace instance based on the index to the space
    /// </summary>
    /// <param name="rf">RayFace instance</param>
    /// <param name="index"></param>
    public void AddRayFaceFunction(Ray_Face rf, int index)
    {
      if(rf.FaceIndex != index)
      {
        throw new ArgumentException("faceindex does not match the given index", "index");
      }
      rayfaces[index] = rf;
    }
    public List<Point3d> GetOriginPoints(int faceindex)
    {
      return rayfaces[faceindex].Face_Rays_Origins;
    }

    /// <summary>
    /// gets the number of recieved rays for given face
    /// </summary>
    /// <param name="facenumber"></param>
    /// <returns></returns>
    public int EachFaceLightCount(int facenumber)
    {
      var temp = rayfaces[facenumber];
      if (temp != null)
      {
        return rayfaces[facenumber].Count();
      }
      else
      {
        Console.WriteLine("no rays was added to this face");
        return 0;
      }
    }
    /// <summary>
    /// create plains for a face(usually used for windows)
    /// </summary>
    /// <param name="faceindex">index of face </param>
    /// <returns>the plane</returns>
    public Plane CreateFacePlane(int faceindex)
    {
      Plane plane = Plane.Unset;
      try
      {
        List<Point3d> corners = rayfaces[faceindex].FaceCorners;
        Point3d center = Generals.AvaragePointCalculator(corners);
        Point3d yaxis = (corners[2] + corners[3]) / 2;
        var xaxis = (corners[1] + corners[3]) / 2;
        plane = new Plane(center, xaxis, yaxis);
        if (!plane.IsValid)
        {
          throw new ArgumentNullException("built plain is null");
        }
      }
      catch(Exception)
      {

      }

      return plane;
    }
    /// <summary>
    /// checks if the face satisfy the light condition
    /// </summary>
    /// <param name="accuracy">the parameter from GenLight class fields</param>
    /// <param name="conditionlist">the list of conditions for light</param>
    /// <returns>true if the light condition is satisfied</returns>
    public bool LightCheck(int accuracy, List<string> conditionlist,double tolerance=0.5)
    {
      if (Light == 0)
      {
        return true;
      }
      else
      {
        accuracy--;
        int[] templist = Generals.GetString(conditionlist[Light - 1]);
        for (int i = 0; i < templist.Length; i++)
        {

          if (EachFaceLightCount(templist[i]) >= (accuracy * accuracy) * tolerance)
          {
            WinFacePlane = CreateFacePlane(templist[i]);
            lightface = templist[i];
            return true;
          }

        }
        return false;

      }

    }

  }


  /////////////////////////////////////
  ///////////////House class
  ////////////////////////////////////
  public class House
  {
    public List<Space> Each_House { get; set; }
    public List<double> Rotations { get; set; }


    public House()
    {
      Each_House = new List<Space>();
      Rotations = new List<double>();
    }
    /// <summary>
    /// add spaces to a House
    /// </summary>
    /// <param name="type"></param>
    /// <param name="light"></param>
    /// <param name="area"></param>
    /// <param name="mesh"></param>
    public void Add(int type, int light, double area, Mesh mesh)
    {
      Each_House.Add(new Space(type, light, area, mesh));
    }

    /// <summary>
    /// gets all meshes of spaces in the house
    /// </summary>
    /// <returns>meshes</returns>
    public List<Mesh> GetMeshes()
    {
      var meshes = new List<Mesh>();
      foreach (var space in Each_House)
      {

        meshes.Add(space.mesh);
      }
      return meshes;
    }

    /// <summary>
    /// gets all the types of the spaces of the house
    /// </summary>
    /// <returns></returns>
    public List<int> GetTypes()
    {
      List<Space> ZeroTypeCheck = Each_House.FindAll(space => space.Type == 0);
      var types = new List<int>();
      foreach (var space in Each_House)
      {
        types.Add(space.Type);
      }

      if(ZeroTypeCheck.Count != 1)
      {
        throw new ArgumentException("each house should have only one space with Type 0 as Enterance ");
      }
      return types;
    }

    /// <summary>
    /// gets all the areas of the spaces of the house
    /// </summary>
    /// <returns>areas</returns>
    public List<double> GetAreas()
    {
      var areas = new List<double>();
      foreach (var space in Each_House)
        areas.Add(space.Area);
      return areas;
    }

    /// <summary>
    /// gets all the lights of the spaces of the house
    /// </summary>
    /// <returns>lights</returns>
    public List<int> GetLights()
    {
      var lights = new List<int>();
      foreach (var space in Each_House)
        lights.Add(space.Light);
      return lights;
    }

    /// <summary>
    /// gets the center of the type 0 mesh
    /// </summary>
    /// <returns>center point</returns>
    public Point3d GetEnteranceCenter()
    {
      var Center = new Point3d();
      foreach (var space in Each_House)
      {
        if (space.Type == 0)
        {
          BoundingBox bo = space.mesh.GetBoundingBox(false);
          Center = bo.Center;
        }
        else
          continue;
      }
      return Center;
    }
    /// <summary>
    /// gets all center points of the meshes of a house
    /// </summary>
    /// <returns>centers</returns>
    public List<Point3d> GetAllCenters()
    {
      var CentersAll = new List<Point3d>();
      try
      {
        foreach (var space in Each_House)
        {

          BoundingBox bo = space.mesh.GetBoundingBox(false);
          var Centertemp = bo.Center;
          CentersAll.Add(Centertemp);
        }
      }
      catch(Exception)
      {
        RhinoApp.WriteLine("problem with GetAllCenters method ");
      }
      return CentersAll;

    }
    /// <summary>
    /// moves a copy of a house with a vector
    /// </summary>
    /// <param name="vec">move vector/param>
    /// <param name="house">the House</param>
    /// <returns></returns>

    public static House HouseMove(Vector3d vec, House house)
    {
      if(!vec.IsValid || vec.IsZero)
      {
        throw new ArgumentNullException("vector", "zero or null vector detected");
      }
      var test = new House();
      try
      {
        for (int k = 0; k < house.GetMeshes().Count; k++)
        {
          var copymesh = house.Each_House[k].mesh.Duplicate();
          bool Move = copymesh.Translate(vec.X, vec.Y, vec.Z);
          test.Add(house.Each_House[k].Type, house.Each_House[k].Light, house.Each_House[k].Area, (Mesh) copymesh);
          test.AddConnectedFace();

        }
      }
      catch(Exception)
      {
        RhinoApp.WriteLine("problem with HouseMove method");
      }

      return test;

    }
    /// <summary>
    /// adds all rotations allowed for a House instance
    /// </summary>
    /// <param name="inputrotation"></param>
    public void RotationAdd(List<double> inputrotation)
    {

      foreach (var rot in inputrotation)
      {
        if(rot > 6.29)
        {
          throw new ArgumentOutOfRangeException("rotation angle", "angles must be in radian");
        }
        Rotations.Add(rot);
      }
    }

    /// <summary>
    /// adds connected faces to a House object
    /// </summary>
    public void AddConnectedFace()
    {
      for (int i = 0;i < Each_House.Count - 1;i++)
      {
        for(int j = i + 1;j < Each_House.Count;j++)
        {
          AddConnectedFaces(Each_House[i], Each_House[j]);
        }

      }
    }
    /// <summary>
    /// adds connected faces to to space objects
    /// </summary>
    /// <param name="space_1"></param>
    /// <param name="space_2"></param>
    private void AddConnectedFaces(Space space_1, Space space_2)
    {
      try
      {
        for (int i = 1; i < 7; i++)
        {
          var face_1Center = Generals.AvaragePointCalculator(GenRays.GetFaceCorners(i, space_1.mesh));
          for (int j = 1; j < 7; j++)
          {
            var face_2center = Generals.AvaragePointCalculator(GenRays.GetFaceCorners(j, space_2.mesh));
            if (Generals.DistanceBetweenPoints(face_1Center, face_2center) < 0.1)
            {
              space_1.AddConnectedFace(i);
              space_2.AddConnectedFace(j);
            }
          }
        }
      }
      catch(Exception)
      {
        RhinoApp.WriteLine("problem with AddConnectedFaces method");
      }

    }
  }

  ////////////////////////////////////////
  ////////////////All Houses related functions
  ////////////////////////////////////////

  /// <summary>
  /// handels the functions regarding all Houses in a block alternative
  /// </summary>
  public class AllHouses
  {
    public List<List<House>> Tabaghat;
    public List<Point3d> pointcheck;
    public AllHouses(List<Point3d> ptcheck)
    {
      this.pointcheck = ptcheck;
      Tabaghat = new List<List<House>>();

    }
    /// <summary>
    /// add all Houses belonging to this alternative
    /// </summary>
    /// <param name="tabaghat"></param>
    public void AssignFloor(List<List<House>> tabaghat)
    {
      try
      {
        if (tabaghat.Count == 0 || tabaghat == null)
        {
          throw new ArgumentException(String.Format("there are no floors to add or {0}is null", tabaghat));
        }
        foreach (var a in tabaghat)
        {
          var temp = new List<House>();
          for(int i = 0; i < a.Count;i++)
          {
            temp.Add(a[i]);
          }
          Tabaghat.Add(temp);
        }
      }
      catch(ArgumentException)
      { }
    }
    /// <summary>
    /// converts all meshes to brep ( for rayshoot method)
    /// </summary>
    /// <param name="inputlist">List of Houses containing meshes</param>
    /// <param name="Lightsurfaces">list of surfaces</param>
    /// <returns></returns>

    public static List<Brep> GetAllHouseBreps(List<List<House>> inputlist, List<Surface> Lightsurfaces)
    {
      var brps = new List<Brep>();
      try
      {    //flattening the input list
        var Listmesh = new List<Mesh>();
        foreach (var i in inputlist)
        {
          foreach (var j in i)
          {
            var temp = j.GetMeshes();
            foreach (var k in temp)
            {
              Listmesh.Add(k);
            }
          }
        }
        //adding meshes of flattened list
        foreach (var i in Listmesh)
        {
          brps.Add(Brep.CreateFromMesh(i, false));
        }
        //adding surfaces;
        foreach (var s in Lightsurfaces)
        {
          brps.Add(s.ToBrep());
        }

      }

      catch (Exception)
      {
        RhinoApp.WriteLine("something wrong happened in the GetAllHouseBreps method");
      }
      return brps;
    }
    /// <summary>
    /// converts all meshes to brep ( for rayshoot method) and also add aditional breps
    /// </summary>
    /// <param name="inputlist"></param>
    /// <param name="Lightsurfaces"></param>
    /// <param name="additionalbreps"></param>
    /// <returns></returns>
    public static List<Brep> GetAllHouseBreps(List<List<House>> inputlist, List<Surface> Lightsurfaces, List<Brep> additionalbreps)
    {
      var brps = new List<Brep>();
      try
      {
        var Listmesh = new List<Mesh>();
        foreach (var i in inputlist)
        {
          foreach (var j in i)
          {
            var temp = j.GetMeshes();
            foreach (var k in temp)
            {
              Listmesh.Add(k);
            }
          }
        }
        foreach (var i in Listmesh)
        {
          brps.Add(Brep.CreateFromMesh(i, false));
        }
        foreach (var s in Lightsurfaces)
        {
          brps.Add(s.ToBrep());
        }
        foreach (var i in additionalbreps)
        {
          brps.Add(i);
        }
      }
      catch(Exception)
      {
        RhinoApp.WriteLine("something wrong happened in the GetAllHouseBreps method");
      }
      return brps;
    }


  }
  //////////////////////////////////////
  //////////////RayFace
  //////////////////////////////////////

  public class Ray_Face
  {
    /// <summary>
    /// gives the interssection points of light surfaces and rays of the face
    /// </summary>
    public List<Point3d> Srf_Intersections { get; private set; }
    /// <summary>
    /// gives the origin of successful ray intersections
    /// </summary>
    public List<Point3d> Face_Rays_Origins { get; private set; }
    /// <summary>
    /// gets the corners of the face
    /// </summary>
    public List<Point3d> FaceCorners { get; private set; }
    /// <summary>
    /// gets the index of the face
    /// </summary>
    public int FaceIndex { get; private set; }


    public Ray_Face(List<Point3d> srf_Intersection_Counts, List<Point3d> originpoints, List<Point3d> facecorners, int faceindex)
    {
      this.Srf_Intersections = srf_Intersection_Counts;
      this.FaceCorners = facecorners;
      this.FaceIndex = faceindex;
      this.Face_Rays_Origins = originpoints;
    }
    /// <summary>
    /// gets the count of the intersection points
    /// </summary>
    /// <returns>count</returns>
    public int Count()
    {
      return Srf_Intersections.Count;
    }
  }
  ////////////////////////////////////////
  ////////////////enum for face numbers
  ////////////////////////////////////////
  public enum FaceIndex
  {
    Face1 = 1,
    Face2 = 2,
    Face3 = 3,
    Face4 = 4,
    Face5 = 5,
    Face6 = 6
  }


  ////////////////////////////////////////
  //////////////////General Loop Functions
  ////////////////////////////////////////
  static class GenLoop
  {
    /// <summary>
    /// creats a list of integers for House List indexes
    /// </summary>
    /// <param name="houses">list of houses</param>
    /// <returns>indexes</returns>
    public static List<int> GetHouseNumbersForPermutation(List<House> houses)
    {
      var TempNumbers = new List<int>();
      var it = 0;
      foreach (var a in houses)
      {
        TempNumbers.Add(it);
        it++;
      }
      return TempNumbers;
    }
    /// <summary>
    /// builds the list of point indices
    /// </summary>
    /// <param name="enterance_points_of_a_floor">list of points</param>
    /// <returns>list of indices</returns>
    public static List<int> GetEnteranceIndexList(List<Point3d> enterance_points_of_a_floor)
    {
      var indexlist = new List<int>();
      var count = enterance_points_of_a_floor.Count;
      for(int i = 0; i < count;i++)
      {
        indexlist.Add(i);
      }
      return indexlist;

    }
    /// <summary>
    /// removes the alternatives that are simillar
    /// </summary>
    /// <param name="Enteranceindexes">the initial array</param>
    /// <param name="Combination">list of combinations</param>
    /// <param name="Permutation">list of permutations</param>
    /// <returns></returns>
    public static List<List<int>> RemoveDupObjects(List<int> Enteranceindexes, List<int> Combination, List<List<int>> Permutation)
    {

      if(Enteranceindexes == null || Combination == null || Permutation == null)
      {
        throw new ArgumentNullException("input", "one of the inputs is null");
      }
      var result = new List<int[]>();
      try
      {
        for (int j = Permutation.Count - 1; j > -1; j--)
        {
          var temp = ArrayWithDefaulValue(Enteranceindexes, -1);
          for (int k = 0; k < Permutation[j].Count; k++)
          {
            temp[Permutation[j][k]] = Combination[k];
            if (!CheckDupArray(temp, result))
            {
              Permutation.RemoveAt(j);

            }
          }
          result.Add(temp);
        }
      }
      catch(Exception)
      {
        RhinoApp.WriteLine("problem with  RemoveDupObjects method");
      }

      return Permutation;

    }
    /// <summary>
    /// builds an array with a default value
    /// </summary>
    /// <param name="listtoclone"></param>
    /// <param name="defaultvalue">default value</param>
    /// <returns>the array</returns>
    public static int[] ArrayWithDefaulValue(List<int> listtoclone, int defaultvalue)
    {

      var EmptyArray = new int[listtoclone.Count];
      try
      {
        for (int i = 0; i < EmptyArray.Length; i++)
        {
          EmptyArray[i] = defaultvalue;
        }
      }
      catch(Exception)
      {
        RhinoApp.WriteLine("problem with ArrayWithDefaulValue method");
      }
      return EmptyArray;
    }
    /// <summary>
    /// true if the array is not in the list of arrays
    /// </summary>
    /// <param name="arraytocheck">single array to check</param>
    /// <param name="listofarrays">list of arrays</param>
    /// <returns></returns>
    public static bool CheckDupArray(int[] arraytocheck, List<int[]> listofarrays)
    {
      try
      {
        for (int i = 0; i < listofarrays.Count; i++)
        {
          if (checkEquality(arraytocheck, listofarrays[i]))
          {
            return false;
          }
        }
      }
      catch(Exception)
      {
        RhinoApp.WriteLine("problem with CheckDupArray method");
      }
      return true;
    }
    /// <summary>
    /// if true both arrays are equal
    /// </summary>
    /// <param name="first"></param>
    /// <param name="second"></param>
    /// <returns></returns>
    public static bool checkEquality (int[] first, int[] second)
    {
      return Enumerable.SequenceEqual(first, second);
    }

  }
  ////////////////////////////////////////
  ///////////////Conditions
  ////////////////////////////////////////
  public abstract class Condition
  {
    public bool Button { get; set; }
    public List<List<House>> PreviousHousesList { get; set; }

    public Condition(List<List<House>> PreviousHousesList)
    {
      this.PreviousHousesList = PreviousHousesList;
    }
    public abstract bool ExecuteCondition();


  }
  ///////////////////////////////////////
  /////////////Light Condition
  ///////////////////////////////////////
  public class Light: Condition
  {
    public GenLight GeneralLight { get; set; }
    public List<Brep> AllBreps { get; set; }
    public List<String> LightConditions { get; set; }
    public Light(bool button, List<List<House>> PreviousHousesList, GenLight generalLight, List<Brep> allbreps, List<String> lightconditions)
      : base(PreviousHousesList)
    {
      this.Button = button;
      this.GeneralLight = generalLight;
      this.AllBreps = allbreps;
      this.LightConditions = lightconditions;
    }
    public override bool ExecuteCondition()
    {
      if (Button == false)
      {
        return true;
      }
      else
      {
        AddLightToSpaces(GeneralLight, AllBreps);
        var conditionfinal = Conditions(LightConditions);
        return conditionfinal;

      }



    }
    private void AddLightToSpaces(GenLight generallight, List<Brep> AllBreps)
    {
      foreach (List<House> listhouse in PreviousHousesList)
      {
        generallight.AddLightToListOfHouse(listhouse, AllBreps);
      }

    }
    private bool Conditions(List<String> LightConditions)
    {
      var ShartLight = true;
      try
      {
        for (int i = 0; i < PreviousHousesList.Count; i++)
        {
          for (int ja = 0; ja < PreviousHousesList[i].Count; ja++)
          {
            for (int k = 0; k < PreviousHousesList[i][ja].Each_House.Count; k++)
            {
              var shartbool = PreviousHousesList[i][ja].Each_House[k].LightCheck(5, LightConditions);
              if (shartbool == false)
              {
                ShartLight = false;
              }
            }
          }
        }
      }
      catch(Exception)
      {
        RhinoApp.WriteLine("problem with Conditions Method in Light Class");
      }
      return ShartLight;
    }
  }

  //////////////////////////////////////////
  /////////////////Privecy condition
  //////////////////////////////////////////
  class Privecy : Condition
  {
    public List<double> PrivecyInfo { get; set; }
    public Privecy(bool button, List<List<House>> PreviousHousesList, List<double> privecy)
      :base(PreviousHousesList)
    {
      this.Button = button;
      this.PrivecyInfo = privecy;
    }

    public  override bool ExecuteCondition()
    {
      if(Button == false)
      {
        return true;
      }
      else
      {
        List<Space> spacelist = AddAllSpaces();
        var conditionfinal = Conditions(spacelist, PrivecyInfo);
        return conditionfinal;
      }


    }
    private  List<Space> AddAllSpaces()
    {
      var tempspacelist = new List<Space>();
      try
      {
        for (int i = 0; i < PreviousHousesList.Count; i++)
        {
          for (int ja = 0; ja < PreviousHousesList[i].Count; ja++)
          {
            for (int k = 0; k < PreviousHousesList[i][ja].Each_House.Count; k++)
            {
              if (PreviousHousesList[i][ja].Each_House[k].Light != 0)
              {
                tempspacelist.Add(PreviousHousesList[i][ja].Each_House[k]);
              }
            }
          }
        }
      }
      catch(Exception)
      {
        RhinoApp.WriteLine("problem with AddAllSpaces method in Privecy class");
      }
      return tempspacelist;

    }
    private bool Conditions(List<Space> tempspacelist, List<double> privecy)
    {
      bool ShartPrivecy = true;
      try
      {
        for (int i = 0; i < tempspacelist.Count; i++)
        {
          for (int ja = i + 1; ja < tempspacelist.Count; ja++)
          {
            bool shartbool = PrivecyCheck(tempspacelist[i], tempspacelist[ja], privecy[0], privecy[1]);
            if (shartbool == false)
            {
              ShartPrivecy = false;
            }

          }
        }
      }
      catch(Exception)
      {
        RhinoApp.WriteLine("problem with Conditions method in privecy class");
      }
      return ShartPrivecy;
    }

    /// <summary>
    /// checks if privecy condition works for 2 spaces
    /// </summary>
    /// <param name="a">first space</param>
    /// <param name="b">second space</param>
    /// <param name="angle">limit angle</param>
    /// <param name="distance">limit distance</param>
    /// <returns>true if the condition has no problem</returns>
    public static bool PrivecyCheck(Space a, Space b, double angle, double distance)
    {
      if (angle >= 6.29)
      {
        throw new ArgumentOutOfRangeException("angle", "angle is not within the range of 0 to 2*pi are you sure you are not using angle in degree?");
      }
      if (!a.WinFacePlane.IsValid || !b.WinFacePlane.IsValid)
      {
        RhinoApp.WriteLine("one or both plains were null");
        return true;
      }
      Vector3d normal_a = a.WinFacePlane.Normal;
      Vector3d normal_b = b.WinFacePlane.Normal;
      Point3d center_a = a.WinFacePlane.Origin;
      Point3d center_b = b.WinFacePlane.Origin;
      Vector3d vector = center_b - center_a;
      if (vector.Length > distance)
      {
        return true;
      }
      var angle_1 = Vector3d.VectorAngle(vector, normal_a);
      var angle_2 = Vector3d.VectorAngle(-1 * vector, normal_b);
      if (angle_2 >= angle || angle_1 >= angle)
      {
        return true;
      }
      return false;
    }


  }

  ////////////////////////////////////////
  ////////////////main loop
  ////////////////////////////////////////
  public class Tabaghatloop
  {
    public int Accuracy { get; set; }
    public List<Brep> AdditionalBreps { get; set; }
    public List<List<Point3d>> EnteranceList { get; set; }
    public List<House> Houses { get; set; }
    public List<string> LightConditions { get; set; }
    public List<Surface> LightSurfaces { get; set; }
    public List<Vector3d> NormalList { get; set; }
    public List<double> PrivecyOptions { get; set; }
    public List<int> TempNumbers { get; set; }
    public List<Point3d> UnWantedPts { get; set; }

    private readonly GenLight GeneralLight;
    public bool PrivecyButton { get; set; }
    public bool LightButton { get; set; }
    public Tabaghatloop(int accuracy, List<Brep> additionalBreps, List<List<Point3d>> enteranceList, List<House> houses,
      bool lightButton, List<string> lightConditions, List<Surface> lightSurfaces, List<Vector3d> normalList,
      bool privecyButton, List<double> privecyOptions, List<int> tempNumbers, List<Point3d> unWantedPts)
    {
      this.Accuracy = accuracy;
      this.AdditionalBreps = additionalBreps;
      this.EnteranceList = enteranceList;
      this.Houses = houses;
      this.LightButton = lightButton;
      this.LightConditions = lightConditions;
      this.LightSurfaces = lightSurfaces;
      this.NormalList = normalList;
      this.PrivecyButton = privecyButton;
      this.PrivecyOptions = privecyOptions;
      this.TempNumbers = tempNumbers;
      this.UnWantedPts = unWantedPts;
      this.GeneralLight = new GenLight(Accuracy, LightConditions, normalList, LightSurfaces);

    }


    /// <summary>
    /// Main Loop Function
    /// </summary>
    /// <param name="TedadVahed">Number of Houses in each floor</param>
    /// <param name="floor">the index of floor</param>
    /// <param name="FinaleList">List of Houses completed</param>
    /// <returns>All Possible alternatives to the floor</returns>
    public  List<AllHouses> Tabaghat(int TedadVahed, int floor, List<AllHouses> FinaleList)
    {
      var FinaleListTemp = new List<AllHouses>();
      if (floor == 0)
      {
        FinaleList.Add(new AllHouses(UnWantedPts));
      }

      for (int m = 0; m < FinaleList.Count; m++)
      {
        List<List<int>> CombinationHouseIndexList = Generals.PermutationToList(TempNumbers, TedadVahed, "Combination");

        List<int> EnteranceIndex = GenLoop.GetEnteranceIndexList(EnteranceList[floor]);
        var copyEnteranceIndex = Generals.CopyListOfPoints(EnteranceIndex);
        //check if any of the enterancepoint are in unwanted pts
        for (int i = EnteranceIndex.Count - 1; i > -1 ; i--)
        {

          bool Check1 = Generals.CheckDupPoinInList(EnteranceList[floor][i], FinaleList[m].pointcheck);

          if (Check1 == false)
          {
            EnteranceIndex.RemoveAt(EnteranceIndex[i]);
          }
        }


        foreach (var houseindexes in CombinationHouseIndexList)
        {
          //building enterancepointpermutations
          List<List<int>> PermutationEnteranceIndexList = Generals.PermutationToList(EnteranceIndex, TedadVahed, "Permutation");
          PermutationEnteranceIndexList = GenLoop.RemoveDupObjects(copyEnteranceIndex, houseindexes, PermutationEnteranceIndexList);


          //add chosen houses to a list based on their indexes
          var listhouses = new List<House>();
          for (int t = 0; t < TedadVahed; t++)
          {
            listhouses.Add(Houses[houseindexes[t]]);
          }



          for (int j = 0; j < PermutationEnteranceIndexList.Count; j++)
          {
            bool CHECK = true;
            var VecList = new List<Vector3d>();
            //copying PointCheckList
            var PoinCheckCopy = new List<Point3d>();
            foreach (var pt in FinaleList[m].pointcheck)
            {
              PoinCheckCopy.Add(pt);
            }
            //////////////////////////////////////////////////////
            //building move vectors and checking if they overlap
            //////////////////////////////////////////////////////
            ///
            for (int k = 0; k < listhouses.Count; k++)
            {

              Point3d EnteranceCenter = listhouses[k].GetEnteranceCenter();

              Point3d destPoint = EnteranceList[floor][PermutationEnteranceIndexList[j][k]];
              // now we create the vec for move
              Vector3d vec = new Vector3d(destPoint - EnteranceCenter);
              VecList.Add(vec);

              //getting all center points to check
              List<Point3d> Check = listhouses[k].GetAllCenters();
              List<Point3d> CkeckList = Generals.AddPointWithVector(vec, Check);

              //check if they are in pointcheck list
              bool CHECKDup = Generals.CheckForDuplicatePoints(CkeckList, PoinCheckCopy);
              if (CHECKDup == true)
              {
                foreach (var pt in CkeckList)
                {
                  PoinCheckCopy.Add(pt);
                }
              }
              else
              {
                CHECK = false;


              }
            }

            ////////////////////////////////////////////
            //moving
            ////////////////////////////////////////////
            if (CHECK == true)
            {

              List<List<House>> PreviousHousesList = new List<List<House>>();
              var MovedList = new List<House>();
              for (int t = 0; t < TedadVahed; t++)
              {
                MovedList.Add((House.HouseMove(VecList[t], listhouses[t])));
              }

              for (int c = 0; c < floor; c++)
              {
                PreviousHousesList.Add(FinaleList[m].Tabaghat[c]);
              }
              PreviousHousesList.Add(MovedList);


              List<Brep> AllBreps = AllHouses.GetAllHouseBreps(PreviousHousesList, LightSurfaces, AdditionalBreps);

              /////////////////////////////////////
              ///Conditions
              /////////////////////////////////////

              if (LightButton == false && PrivecyButton == true)
              {
                throw new ArgumentException("if you want the privecy condition , light condition must be on too ");
              }
              try
              {
                var templight = new Light(LightButton, PreviousHousesList, GeneralLight, AllBreps, LightConditions);
                var tempprivecy = new Privecy(PrivecyButton, PreviousHousesList, PrivecyOptions);
                var ListConditions = new List<Condition>() { templight, tempprivecy };
                var conditionCheck = true;
                foreach (var condition in ListConditions)
                {
                  var tempcheck = condition.ExecuteCondition();
                  if (tempcheck == false)
                  {
                    conditionCheck = false;
                    break;
                  }
                }
                if (conditionCheck)
                {
                  var AllHouseTemp = new AllHouses(PoinCheckCopy);
                  AllHouseTemp.AssignFloor(PreviousHousesList);
                  FinaleListTemp.Add(AllHouseTemp);
                }
              }
              catch (Exception)
              {
                RhinoApp.WriteLine("problem with Conditions part of Tabaghat class");
              }



            }

          }
        }

      }

      return FinaleListTemp;
    }
  }
# ---------- end c_script_3 ----------
panel_26 = Panel(c_script_3.out)
panel_27 = Panel(c_script_3.OModulesCount)
panel_28 = Panel(c_script_3.OWinFacePlane)
panel_29 = Panel(c_script_3.OVerticalConnection)
panel_30 = Panel(c_script_3.OAlternativesCount)

panel_31 = Panel(c_script_3.Test)
mesh_6 = Mesh(c_script_3.OMeshes)
int = Integer(c_script_3.OModulesCount)
number_slider_7 = Slider(0, range=0..299)

# ----
# Meshs
mesh_7 = Mesh(mesh_6)
# number of spaces in each house
int_2 = Integer(int)
pt_5 = Point(Tree({0}: [Point(13.5, -83.62628134, 22.45031018), Point(13.5, -83.89482965, 21.313764), Point(13.5, -83.49200719, 23.01858328), Point(13.5, -83.35773303, 23.58685637), Point(13.5, -83.22345888, 24.15512946), Point(14.5, -83.62628134, 22.45031018)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], {1}: [Point(13.5, -83.62628134, 22.45031018), Point(13.5, -83.89482965, 21.313764), Point(13.5, -83.49200719, 23.01858328), Point(13.5, -83.35773303, 23.58685637), Point(13.5, -83.22345888, 24.15512946), Point(14.5, -83.62628134, 22.45031018)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], {2}: [Point(13.5, -83.62628134, 22.45031018), Point(13.5, -83.89482965, 21.313764), Point(13.5, -83.49200719, 23.01858328), Point(13.5, -83.35773303, 23.58685637), Point(13.5, -83.22345888, 24.15512946), Point(14.5, -83.62628134, 22.45031018)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], {3}: [Point(13.5, -83.62628134, 22.45031018), Point(13.5, -83.89482965, 21.313764), Point(13.5, -83.49200719, 23.01858328), Point(13.5, -83.35773303, 23.58685637), Point(13.5, -83.22345888, 24.15512946), Point(14.5, -83.62628134, 22.45031018)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], {4}: [Point(13.5, -83.62628134, 22.45031018), Point(13.5, -83.89482965, 21.313764), Point(13.5, -83.49200719, 23.01858328), Point(13.5, -83.35773303, 23.58685637), Point(13.5, -83.22345888, 24.15512946), Point(14.5, -83.62628134, 22.45031018)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], {5}: [Point(13.5, -83.62628134, 22.45031018), Point(13.5, -83.89482965, 21.313764), Point(13.5, -83.49200719, 23.01858328), Point(13.5, -83.35773303, 23.58685637), Point(13.5, -83.22345888, 24.15512946), Point(14.5, -83.62628134, 22.45031018)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]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))  # disabled
# win planes
pln = Plane(c_script_3.OWinFacePlane)
# mesh centers
pt_6 = Point(c_script_3.OMeshCenters)

branch = TreeBranch(Tree=mesh_7, Path=number_slider_7, MaintainPaths=True)
branch_2 = TreeBranch(Tree=int_2, Path=number_slider_7, MaintainPaths=True)
branch_3 = TreeBranch(Tree=pt_5, Path=number_slider_7, MaintainPaths=True)  # disabled
branch_4 = TreeBranch(Tree=pln, Path=number_slider_7, MaintainPaths=True)
branch_5 = TreeBranch(Tree=pt_6, Path=number_slider_7, MaintainPaths=True)

branch_6 = TreeBranch(Tree=c_script_3.OGetTypes, Path=number_slider_7, MaintainPaths=True)
partition = PartitionList(List=branch_6, Size=branch_2)  # -> simplify(Chunks)
area_4 = Area(Geometry=branch)  # -> Area, Centroid
expression = Expression(x=branch_6, y=Slider(1, range=0..1), Expression="x = y")
cull = CullPattern(List=area_4.Centroid, CullPattern=expression)
clean_7 = CleanTree(RemoveNulls=True, RemoveInvalid=True, RemoveEmpty=False, Tree=branch_4)
pln_2 = Plane(clean_7)

partition_2 = PartitionList(List=branch, Size=branch_2)  # -> simplify(Chunks)
branch_7 = TreeBranch(Tree=partition_2, Path="0", MaintainPaths=True)
branch_8 = TreeBranch(Tree=partition_2, Path="1", MaintainPaths=True)
branch_9 = TreeBranch(Tree=partition_2, Path="2", MaintainPaths=True)
branch_10 = TreeBranch(Tree=partition_2, Path="3", MaintainPaths=True)
branch_11 = TreeBranch(Tree=partition_2, Path="4", MaintainPaths=True)
branch_12 = TreeBranch(Tree=partition_2, Path="5", MaintainPaths=True)
branch_13 = TreeBranch(Tree=partition_2, Path="6", MaintainPaths=True)
branch_14 = TreeBranch(Tree=partition_2, Path="7", MaintainPaths=True)
swatch = ColourSwatch(SwatchColor=RGB(248, 215, 144))
panel_32 = Panel(partition_2)  # disabled
swatch_2 = ColourSwatch(SwatchColor=RGB(80, 131, 117))  # disabled
swatch_3 = ColourSwatch(SwatchColor=RGB(83, 78, 117))  # disabled
swatch_4 = ColourSwatch(SwatchColor=RGB(253, 166, 0))  # disabled
swatch_5 = ColourSwatch(SwatchColor=RGB(192, 141, 0))  # disabled
swatch_6 = ColourSwatch(SwatchColor=RGB(56, 26, 117))  # disabled
preview = CustomPreview(Geometry=branch_7, Material=swatch)
preview_2 = CustomPreview(Geometry=branch_8, Material=swatch)
preview_3 = CustomPreview(Geometry=branch_9, Material=swatch)
preview_4 = CustomPreview(Geometry=branch_10, Material=swatch)
preview_5 = CustomPreview(Geometry=branch_11, Material=swatch)
preview_6 = CustomPreview(Geometry=branch_12, Material=swatch)
preview_7 = CustomPreview(Geometry=branch_13, Material=ColourSwatch(SwatchColor=RGB(210, 79, 0)))

merge = Merge(Data1=cull, Data2=c_script_3.OVerticalConnection)  # -> flatten(Result)
mesh_8 = Mesh(branch)
pt_7 = Point(merge)

# ---- group: ducts
c_script_4 = CSharpScript(pts=merge, ModuleX=number_slider_3, ModuleY=number_slider_2)  # -> out, A, B, C; inputs pts: list of Point3d, ModuleX: Double, ModuleY: Double
# ---------- c_script_4: C# usings ----------
using System.Linq;
# ---------- c_script_4: C# ----------
    var list = new List<List<Point3d>>();
    var listeslah = Generals.RemoveDuplicate2D(pts);
    var listducts = new List<Point3d>();
    var genduct = new GenDuct(ModuleX, ModuleY, 3);
    for (int i = 0 ; i < listeslah.Count;i++)
    {
      list.Add(genduct.JointMaker(listeslah[i]));
    }
    var listflatten = Generals.Flatten(list);
    List<SamePoints> samepointclass = GenDuct.AddDuplicate(listflatten);

    listducts = genduct.DuctPositioning(samepointclass);
    var tt = new List<Point3d>();
    foreach (var s in samepointclass)
    {
      tt.Add(s.pts[0]);
    }
    B = tt;
    C = listflatten;

    A = listducts;
# ---------- c_script_4: C# additional code ----------
  class GenDuct
  {
    public double ModuleX { get; set; }
    public double ModuleY { get; set; }
    public double ModuleZ { get; set; }
    public GenDuct(double x, double y, double z)
    {
      this.ModuleX = x;
      this.ModuleY = y;
      this.ModuleZ = z;
    }
    public void FirstCondition(List<SamePoints> ListToOrder, List<Point3d> DuctPoints)
    {
      try
      {
        var dist = new List<SamePoints>();
        for (int j = 0; j < ListToOrder.Count; j++)
        {
          for (int i = 0; i < DuctPoints.Count; i++)
          {
            if (Generals.DistanceBetweenPoints2D(ListToOrder[j].pts[0], DuctPoints[i]) <= Math.Sqrt(2) * ModuleX + 0.01)
            {
              ListToOrder[j].CheckDiagonally = true;
            }

          }
        }

      }
      catch(Exception)
      {
        RhinoApp.WriteLine("problem with the FirstCondition method");
      }

    }
    /// <summary>
    /// sets the second condition , which module has the most priority considernig its adjacents
    /// </summary>
    /// <param name="ListToOrder">the sampepoint list</param>
    /// <param name="DuctPoints">the list of points set as duct points</param>
    public void SecondCondition(List<SamePoints> ListToOrder, List<Point3d> DuctPoints)
    {
      try
      {
        for (int j = 0; j < ListToOrder.Count; j++)
        {
          for (int k = 0; k < ListToOrder.Count; k++)
          {
            if (Math.Abs(Generals.DistanceBetweenPoints2D(ListToOrder[j].pts[0], ListToOrder[k].pts[0]) - ModuleX) < 0.01)
            {
              ListToOrder.ElementAt(j).Countpriority++;
            }
          }
        }

      }
      catch(Exception)
      {
        RhinoApp.WriteLine("problem with the SecondCondition method");
      }


    }
    /// <summary>
    /// apply priorities
    /// </summary>
    /// <param name="ListToOrder"></param>
    /// <param name="DuctPoints"></param>
    public void SetPriorities(List<SamePoints> ListToOrder, List<Point3d> DuctPoints)
    {
      try
      {
        FirstCondition(ListToOrder, DuctPoints);
        SecondCondition(ListToOrder, DuctPoints);


        foreach (var sp in ListToOrder)
        {
          sp.MeasurePriority();
        }
        ListToOrder = ListToOrder.OrderBy(b => b._Priority).ToList();
      }
      catch(Exception)
      {
        RhinoApp.WriteLine("problem with the SetPriorities method");
      }


    }
    /// <summary>
    /// add points to ducts and delete unwanted points
    /// </summary>
    /// <param name="ListToOrder"></param>
    /// <param name="DuctPoints"></param>
    /// <param name="samepoints"></param>
    /// <returns></returns>
    public List<SamePoints> SetDucts(List<SamePoints> ListToOrder, List<Point3d> DuctPoints, List<SamePoints> samepoints)
    {
      try
      {
        for (int i = ListToOrder.Count - 1; i > -1; i--)
        {
          var temppt = ListToOrder[i].pts[0];

          if (samepoints.Any(b => Generals.DistanceBetweenPoints2D(temppt, b.pts[0]) < Math.Sqrt(2) * ModuleX + 0.01 && Generals.DistanceBetweenPoints2D(temppt, b.pts[0]) > 0.01)
            && !ListToOrder[i].Duct)
          {
            DuctPoints.Add(temppt);
            samepoints = FindAndDelete(temppt, samepoints);
            FindAndSet(temppt, ListToOrder);
            samepoints.Remove(ListToOrder[i]);
          }
        }

      }
      catch(Exception)
      {
        RhinoApp.WriteLine("problem with the SetDucts method");
      }

      return samepoints;

    }
    public List<SamePoints> LoopPriorities(List<SamePoints> priority, List<Point3d> DuctPoints, List<SamePoints> samepoints)
    {
      try
      {
        if (priority.Count() != 0)
        {
          if (DuctPoints.Count != 0)
          {
            SetPriorities(priority, DuctPoints);
          }
          samepoints = SetDucts(priority, DuctPoints, samepoints);
        }
      }
      catch(Exception)
      {
        RhinoApp.WriteLine("problem with the LoopPriorities method");
      }

      return samepoints;
    }
    /// <summary>
    ///
    /// </summary>
    /// <param name="samepoints"></param>
    /// <returns></returns>
    public List<Point3d> DuctPositioning(List<SamePoints> samepoints)
    {
      List<Point3d> DuctPoints = new List<Point3d>();
      try
      {
        List<SamePoints> Priority_4 = samepoints.Where(b => b.Countpt() == 4).ToList();
        samepoints = LoopPriorities(Priority_4, DuctPoints, samepoints);
        List<SamePoints> Priority_3 = samepoints.Where(b => b.Countpt() == 3).ToList();
        samepoints = LoopPriorities(Priority_3, DuctPoints, samepoints);
        List<SamePoints> Priority_2 = samepoints.Where(b => b.Countpt() == 2).ToList();
        samepoints = LoopPriorities(Priority_2, DuctPoints, samepoints);
        List<SamePoints> Priority_1 = samepoints.Where(b => b.Countpt() == 1).ToList();
        FirstCondition(Priority_1, DuctPoints);
        foreach(var sp in Priority_1)
        {
          if(!sp.CheckDiagonally)
          {   var check = false;
            for(int i = 0; i < DuctPoints.Count;i++)
            {
              if(Generals.DistanceBetweenPoints2D(sp.pts[0], DuctPoints[i]) < Math.Sqrt(2) * ModuleX + 0.1)
              {
                check = true;
              }
            }
            if(!check)
            {
              DuctPoints.Add(sp.pts[0]);
            }
                        
          }
        }



      }
      catch(Exception)
      {
        RhinoApp.WriteLine("problem with the DuctPositioning method");

      }


      return DuctPoints;

    }
    /// <summary>
    /// finding the adjacant points to the duct point and deleting them from the list
    /// </summary>
    /// <param name="pt">central point</param>
    /// <param name="ModuleY">module size y</param>
    /// <param name="ModuleX">module size x</param>
    /// <param name="sp">list of points with same type</param>
    /// <returns></returns>
    public List<SamePoints> FindAndDelete(Point3d pt, List<SamePoints> sp)
    {
      try
      {
        var pt1 = new Point3d(pt.X, pt.Y + ModuleY, pt.Z);
        var pt2 = new Point3d(pt.X, pt.Y - ModuleY, pt.Z);
        var pt3 = new Point3d(pt.X + ModuleX, pt.Y, pt.Z);
        var pt4 = new Point3d(pt.X - ModuleX, pt.Y, pt.Z);
        var listpt = new List<Point3d>() { pt1, pt2, pt3, pt4 };
        var listcopy = new List<SamePoints>();
        foreach (var point in sp)
        {
          listcopy.Add(point);
        }
        foreach (var point in listcopy)
        {
          for (int j = 0;j < listpt.Count;j++)
          {
            if (Generals.DistanceBetweenPoints2D(point.pts[0], listpt[j]) < 0.1)
            {
              sp.Remove(point);
            }
          }
        }
      }
      catch(Exception)
      {
        RhinoApp.WriteLine("problem with the FindAndDelete method");
      }
      return sp;

    }
    public void FindAndSet(Point3d pt, List<SamePoints> sp)
    {
      try
      {
        var pt1 = new Point3d(pt.X, pt.Y + ModuleY, pt.Z);
        var pt2 = new Point3d(pt.X, pt.Y - ModuleY, pt.Z);
        var pt3 = new Point3d(pt.X + ModuleX, pt.Y, pt.Z);
        var pt4 = new Point3d(pt.X - ModuleX, pt.Y, pt.Z);
        var listpt = new List<Point3d>() { pt1, pt2, pt3, pt4 };

        foreach (var point in sp)
        {
          for (int j = 0; j < listpt.Count; j++)
          {
            if (Generals.DistanceBetweenPoints2D(point.pts[0], listpt[j]) < 0.1)
            {
              point.Duct = true;
            }
          }
        }
      }
      catch (Exception)
      {
        RhinoApp.WriteLine("problem with the FindAndDelete method");
      }


    }


    /// <summary>
    /// makes the joints around the center of the mesh
    /// </summary>
    /// <param name="pt">list of points</param>
    /// <param name="ModuleX">x of modules</param>
    /// <param name="ModuleY">y of modules</param>
    /// <param name="ModuleZ">z of modules</param>
    /// <returns>joints</returns>
    public List<Point3d> JointMaker(Point3d pt)
    {
      var ptlist = new List<Point3d>();
      //try
      //{
      var vectorLenght = Math.Sqrt(((ModuleX * ModuleX) + (ModuleY * ModuleY)) / 4);
      var vectorDirection1 = (Vector3d.XAxis + Vector3d.YAxis);
      vectorDirection1.Unitize();
      var vectorDirection2 = (Vector3d.XAxis + (-1 * Vector3d.YAxis));
      vectorDirection2.Unitize();
      var movevector1 = (vectorLenght * vectorDirection1) + new Vector3d(0, 0, ModuleZ / 2);
      var movevector2 = vectorLenght * vectorDirection2 + new Vector3d(0, 0, ModuleZ / 2);
      var movevector3 = -1 * vectorLenght * vectorDirection1 + new Vector3d(0, 0, ModuleZ / 2);
      var movevector4 = -1 * vectorLenght * vectorDirection2 + new Vector3d(0, 0, ModuleZ / 2);
      ///////////////
      var pt1 = pt + movevector1;
      var point1 = new Point3d(pt1);
      var pt2 = pt + movevector2;
      var point2 = new Point3d(pt2);
      var pt3 = pt + movevector3;
      var point3 = new Point3d(pt3);
      var pt4 = pt + movevector4;
      var point4 = new Point3d(pt4);

      ptlist = new List<Point3d>() { point1, point2, point3, point4 };
      //}
      //catch(Exception)
      //{
      //    Console.WriteLine("problem with JointMaker method");
      //}

      return ptlist;
    }
    /// <summary>
    /// adding points to the samepoint class (points that are duplicate)
    /// </summary>
    /// <param name="pts"></param>
    /// <returns></returns>
    public static List<SamePoints> AddDuplicate(List<Point3d> pts)
    {
      var list = new List<SamePoints>();
      try
      {
        for (int i = 0; i < pts.Count; i++)
        {
          var sp = new SamePoints();
          sp.Add(pts[i]);
          for (int j = pts.Count - 1; j > i; j--)
          {
            if (Generals.DistanceBetweenPoints2D(pts[i], pts[j]) < 0.1)
            {
              sp.Add(pts[j]);
              pts.RemoveAt(j);
            }
          }
          list.Add(sp);
        }
      }
      catch(Exception)
      {
        RhinoApp.WriteLine("problem with AddDuplicate Method in GenDuct class");
      }
      return list;

    }

  }


  class SamePoints
  {
    public  List<Point3d> pts { get; set; }

    public bool CheckDiagonally { get; set; }
    public int Countpriority { get; set; }
    public int _Priority { get; set; }
    public bool Duct { get; set; }

    public SamePoints()
    {
      this.pts = new List<Point3d>();
    }
    public void Add(Point3d pt)
    {
      pts.Add(pt);
    }
    public int Countpt()
    {
      return pts.Count;
    }
    public void MeasurePriority()
    {
      if (CheckDiagonally)
      {
        _Priority++;
      }
      _Priority += Countpriority;

    }


  }


  public class Ducts
  {
    public List<Point3d> pts{get;set;}

    public Ducts()
    {
      this.pts = new List<Point3d>();
    }
    public void Add(Point3d pt)
    {
      pts.Add(pt);
    }
  }

  ///////////////////////////////////
  /////////////General functions
  //////////////////////////////////


  public static class Generals
  {
    /// <summary>
    /// creats a deep copy of a list of points
    /// </summary>
    /// <param name="list">list of points</param>
    /// <returns>deep copy</returns>
    public static List<int> CopyListOfPoints(List<int> list)
    {
      List<int> Copy = new List<int>();
      for(int i = 0;i < list.Count;i++)
      {
        Copy.Add(list[i]);
      }
      return Copy;
    }
    /// <summary>
    /// removing unwanted points in a brep
    /// </summary>
    /// <param name="ptlist">grid points</param>
    /// <param name="brp">brep</param>
    /// <param name="tel">tolerance</param>
    /// <returns></returns>
    public static List<Point3d> CheckPointINBrep(List<Point3d> ptlist, Brep brp, double tel)
    {
      if(!brp.IsValid)
      {
        throw new ArgumentNullException("brep", "brep is not valid");
      }
      if(ptlist.Count == 0)
      {
        throw new ArgumentNullException("Point list", "The list is empty");
      }
      var unwantedpts = new List<Point3d>();
      for (int i = 0; i < ptlist.Count; i++)
      {
        if (brp.IsPointInside(ptlist[i], tel, false))
        {
          unwantedpts.Add(ptlist[i]);
        }
      }
      return unwantedpts;
    }

    /// <summary>
    /// finds the avarage point between a list of points
    /// </summary>
    /// <param name="pts">list of points</param>
    /// <returns></returns>
    public static Point3d AvaragePointCalculator(List<Point3d> pts)
    {
      if(pts.Count == 0)
      {
        RhinoApp.WriteLine("the avaragecalculator only recieved one point");
      }
      var sum = new Point3d(0, 0, 0);
      for (int i = 0; i < pts.Count; i++)
      {
        sum += pts[i];
      }
      return sum / (pts.Count);
    }
    /// <summary>
    ///
    /// </summary>
    /// <param name="k1"></param>
    /// <param name="k2"></param>
    /// <param name="accuracy"></param>
    /// <returns></returns>
    public static double CaclulateSegments(Point3d k1, Point3d k2, int accuracy)
    {   if(accuracy == 1)
      {
        RhinoApp.WriteLine("beware that no division will happen");
      }
      if(accuracy <= 0)
      {
        throw new ArgumentOutOfRangeException("accuracy", "accuracy must be geater than 0 otherwise zero division or othe exceptions might happen");
      }
      if(!k1.IsValid || !k2.IsValid)
      {
        throw new ArgumentNullException("point", "unvalid point was given");
      }
      var temp = DistanceBetweenPoints(k2, k1) / accuracy;
      return temp;
    }

    /// <summary>
    /// calculates the 2d(xy plane) distance between points
    /// </summary>
    /// <param name="a"></param>
    /// <param name="b"></param>
    /// <returns></returns>
    public static double DistanceBetweenPoints2D(Point3d a, Point3d b)
    {
      if( !a.IsValid || !b.IsValid)
      {
        throw new ArgumentNullException("invalid point detected");
      }
      var dx = a.X - b.X;
      var dy = a.Y - b.Y;
      //var dz = a.Z - b.Z;
      // calculate the distance
      var distance = Math.Sqrt(dx * dx + dy * dy);
      return distance;
    }
    /// <summary>
    /// calculate the distance between 2 points
    /// </summary>
    /// <param name="a">first point</param>
    /// <param name="b">second point</param>
    /// <returns>the distance</returns>
    public static double DistanceBetweenPoints(Point3d a, Point3d b)
    {   if(!a.IsValid || !b.IsValid)
      {
        throw new ArgumentNullException("point", "unvalid point was given");
      }
      var dx = a.X - b.X;
      var dy = a.Y - b.Y;
      var dz = a.Z - b.Z;
      // calculate the distance
      var distance = Math.Sqrt(dx * dx + dy * dy + dz * dz);
      return distance;
    }
    /// <summary>
    /// move a point with a vector
    /// </summary>
    /// <param name="vec">the vector</param>
    /// <param name="pts">the point</param>
    /// <returns>moved point</returns>
    public static List<Point3d> AddPointWithVector(Vector3d vec, List<Point3d> pts)
    {
      if(!vec.IsValid )
      {
        throw new ArgumentNullException("vector", "given vector was not valid");
      }
      if(vec.IsZero)
      {
        throw new ArgumentException("the vector is zero !");
      }
      if(pts.Count == 0)
      {
        throw new ArgumentException("list of points is empty");
      }
      var ListCheck = new List<Point3d>();
      foreach (var pt in pts)
      {
        var temp = pt + vec;
        ListCheck.Add(temp);
      }
      return ListCheck;
    }
    /// <summary>
    /// checks if there are any duplicates in a list of points
    /// </summary>
    /// <param name="ptsToCheck">first list</param>
    /// <param name="CheckList">second list</param>
    /// <returns></returns>
    public static bool CheckForDuplicatePoints(List<Point3d> ptsToCheck, List<Point3d> CheckList)
    {
      var templist = new List<bool>();
      for (int i = 0;i < ptsToCheck.Count;i++)
      {
        for(int j = 0;j < CheckList.Count;j++)
        {
          if (DistanceBetweenPoints(ptsToCheck[i], CheckList[j]) < 0.2)
          {
            templist.Add(false);
          }
        }
      }

      if (templist.Count == 0)
      {
        return true;
      }
      else
      {
        return false;
      }
    }

    /// <summary>
    /// remove points that have same x and y (change the main list)
    /// </summary>
    /// <param name="pts">list of points</param>
    /// <returns> corrected list </returns>
    public static List<Point3d> RemoveDuplicate2D(List<Point3d> pts)
    {
      for (int i = 0; i < pts.Count; i++)
      {
        for (int j = pts.Count - 1; j > i; j--)
        {
          if (Generals.DistanceBetweenPoints2D(pts[i], pts[j]) < 0.1)
          {
            pts.RemoveAt(j);
          }
        }
      }
      return pts;
    }

    /// <summary>
    /// gets the permutation of a list for example for (1,2,3) --> (1,1),(1,2),(1,3),(2,1),(2,2),(2,3),(3,1),(3,2),(3,3)
    /// </summary>
    /// <param name="list">list of objects</param>
    /// <param name="length">number of objects in each permutation</param>
    /// <returns>all permutations</returns>
    private static IEnumerable<IEnumerable<int>> GetPermutationsWithRept(IEnumerable<int> list, int length)
    {
      if (length == 1)
      {
        return list.Select(t => new int[] { t });
      }
      return GetPermutationsWithRept(list, length - 1)
        .SelectMany(t => list,
        (t1, t2) => t1.Concat(new int[] { t2 }));
    }
    /// <summary>
    /// gets the permutation of a list without repetition for example for (1,2,3) --> (1,2),(1,3),(2,1),(2,3),(3,1),(3,2)
    /// </summary>
    /// <param name="list">list of objects</param>
    /// <param name="length">number of objects in each permutation</param>
    /// <returns></returns>
    private static IEnumerable<IEnumerable<int>>GetPermutations(IEnumerable<int> list, int length)
    {
      if (length == 1) return list.Select(t => new int[] { t });
      return GetPermutations(list, length - 1)
        .SelectMany(t => list.Where(o => !t.Contains(o)),
        (t1, t2) => t1.Concat(new int[] { t2 }));
    }
    /// <summary>
    /// gets combinations for example for (1,2,3) --> (1,1),(1,2),(1,3),(2,2),(2,3),(3,3)
    /// </summary>
    /// <param name="list">list of objects</param>
    /// <param name="length">number of objects in each combination</param>
    /// <returns>combinations</returns>
    private static IEnumerable<IEnumerable<int>> GetKCombsWithRept(IEnumerable<int> list, int length)
    {
      if (length == 1) return list.Select(t => new int[] { t });
      {
        return GetKCombsWithRept(list, length - 1).SelectMany(t => list.Where(o => o.CompareTo(t.Last()) >= 0),
          (t1, t2) => t1.Concat(new int[] { t2 }));
      }
    }
    /// <summary>
    /// gets permutation or combination and converts IEnumerations to list
    /// </summary>
    /// <param name="input">raw list</param>
    /// <param name="len">length of each part</param>
    /// <param name="perorcomb">"Combination" or "Permutation"</param>
    /// <returns></returns>
    public static List<List<int>> PermutationToList(List<int> input, int len, string perorcomb)
    {
      var tempnahayee = new List<List<int>>();
      try
      {


        IEnumerable<IEnumerable<int>> temp;
        if (perorcomb == "Permutation")
        {
          temp = GetPermutations(input, len);
        }
        else if (perorcomb == "Combination")
        {
          temp = GetKCombsWithRept(input, len);
        }
        else
        {
          throw new ArgumentOutOfRangeException("perorcomb", "input can only be Permutation or Combination");
        }

        var tempToList = temp.ToList();

        for (int i = 0; i < tempToList.Count; i++)
        {
          tempnahayee.Add(tempToList[i].ToList());
        }
      }
      catch(Exception)
      {
        RhinoApp.WriteLine("problem with PermutationToList function");
      }
      return tempnahayee;
    }
    /// <summary>
    /// checks if a point is in a list of points
    /// </summary>
    /// <param name="pt">the point</param>
    /// <param name="inputlist">the list to check</param>
    /// <returns>true if the point is not in the list</returns>
    public static bool CheckDupPoinInList(Point3d pt, List<Point3d> inputlist, double tolerance= 0.1)
    {
      if(!pt.IsValid)
      {
        throw new ArgumentNullException("point", "given point is not valid");
      }
      if(inputlist.Count == 0)
      {
        return true;
      }
      foreach (var ptcheck in inputlist)
      {
        if (DistanceBetweenPoints(pt, ptcheck) < tolerance)
        {
          return false;
        }
      }
      return true;
    }
    /// <summary>
    /// from a list checks if points are on the list of surfaces
    /// </summary>
    /// <param name="inputpoints">array of intersection points</param>
    /// <param name="srfs">list of surfaces</param>
    /// <param name="tolerance">the tolerance of near points to surface</param>
    /// <returns>points that where on the surface</returns>
    public static List<Point3d> CheckToBeOnSurface(List<Point3d[]> inputpoints, List<Point3d> inputorigins, List<Surface> srfs, out List<Point3d> outputorigins, double tolerance = 0.5)
    {
      for (int i = 0;i < srfs.Count;i++)
      {
        if(!srfs[i].IsValid)
        {
          throw new ArgumentException("unvalid surface detected");
        }
      }
      var OutPutOringins = new List<Point3d>(); ;
      var OutPutList = new List<Point3d>();
      try
      {
        for (int i = 0; i < inputpoints.Count; i++)
        {
          for (int j = 0; j < inputpoints[i].Length; j++)
          {
            foreach (var srf in srfs)
            {
              double u;
              double v;
              var test = srf.ClosestPoint(inputpoints[i][j], out u, out v);
              var temppt = srf.PointAt(u, v);
              var dist = temppt.DistanceTo(inputpoints[i][j]);
              if (dist < tolerance)
              {
                OutPutList.Add(inputpoints[i][j]);
                OutPutOringins.Add(inputorigins[i]);
              }
            }

          }
        }
      }
      catch(Exception)
      {
        RhinoApp.WriteLine("problem with CheckToBeOnSurface function");
      }
      outputorigins = OutPutOringins;
      return OutPutList;

    }

    /// <summary>
    /// calculates the normal of a face
    /// </summary>
    /// <param name="corners">corners of the face</param>
    /// <returns>the normal</returns>
    internal static Vector3d CalculateNormalOfFace(List<Point3d> corners)
    {   for(int i = 0;i < corners.Count;i++)
      {
        if(!corners[i].IsValid)
        {
          throw new ArgumentNullException("corners", "invalid point detected");
        }
      }
      Vector3d a = corners[1] - corners[0];
      Vector3d b = corners[2] - corners[0];
      var result = Vector3d.CrossProduct(a, b);
      return result;
    }
    /// <summary>
    /// flatten a list of arrays
    /// </summary>
    /// <param name="arrays"></param>
    /// <returns>flattend list</returns>
    public static List<Point3d> FlattenArray(List<Point3d[]> arrays)
    {
      var list = new List<Point3d>();
      try
      {
        for (int i = 0; i < arrays.Count; i++)
        {
          foreach (var arry in arrays[i])
          {
            list.Add(arry);
          }
        }
      }
      catch(Exception)
      {
        RhinoApp.WriteLine("problem with FlattenArray function");
      }
      return list;
    }
    public static List<Point3d> Flatten(List<List<Point3d>> list)
    {
      var listflatten = new List<Point3d>();
      try
      {
        for (int i = 0; i < list.Count; i++)
        {
          for (int j = 0; j < list[i].Count; j++)
          {
            listflatten.Add(list[i][j]);
          }
        }
      }
      catch(Exception)
      {
        RhinoApp.WriteLine("problem with Flatten function ");
      }
      return listflatten;
    }
    /// <summary>
    /// gets a string with the format int,int,... and convert it to a list of integer
    /// </summary>
    /// <param name="str">input string</param>
    /// <param name="len">lenght of each output array</param>
    /// <returns>ineger array</returns>
    public static int[] GetString(string str)
    {  //making sure the input is correct
      if (String.IsNullOrWhiteSpace(str))
      {
        throw new ArgumentNullException("input string", "input srting is null or whitespace");
      }
      int[] arrayint = new int[0];
      try
      {
        string[] temp = str.Split(',');
        arrayint = new int[temp.Length];

        for (int i = 0; i < temp.Length; i++)
        {
          try
          {
            int p = int.Parse(temp[i]);
            arrayint[i] = p;
          }
          catch
          {
            throw new ArgumentOutOfRangeException("input string", "string inputs are not convertable to integers.");
          }
        }
      }
      catch(InvalidCastException)
      {
        RhinoApp.WriteLine("wrong input string");
      }
      catch(Exception)
      {
        RhinoApp.WriteLine("wrong input string");
      }
      return arrayint;
    }
    /// <summary>
    /// checks if a number is in a list of numbers
    /// </summary>
    /// <param name="list">list of numbers</param>
    /// <param name="check">number to check</param>
    /// <returns>true if the number is not in the list</returns>
    public static bool CheckDupIntInList(List<int> list, int check)
    {
      if(list.Count == 0 )
      {
        return true;
      }
      for(int i = 0;i < list.Count;i++)
      {
        if(Math.Abs(check - list[i]) < 0.0001)
        {
          return false;
        }
      }
      return true;
    }
  }
# ---------- end c_script_4 ----------
panel_33 = Panel(c_script_4.A)
pt_8 = Point(c_script_4.A)
panel_34 = Panel(c_script_4.out)

# ----
pt_9 = Point(c_script_4.B)
pt_10 = Point(c_script_4.C)
cir = Circle(Plane=pt_8, Radius=1)
Z = UnitZ(Factor=Slider(12, range=0..100))
pt_11 = Point(panel_33)
extr = Extrude(Base=cir, Direction=Z)
panel_35 = Panel(pt_10)

# ---- group: windows
c_script_5 = CSharpScript(
    WindowLength=Slider(2, range=0..10),
    WindowHight=Slider(1, range=0..10),
    DepthForBoolean=Slider(0.5, range=0..1),
    Meshs=mesh_8,
    Planes=pln_2)  # -> out, A, B; inputs WindowLength: Double, WindowHight: Double, DepthForBoolean: Double, Meshs: list of Mesh, Planes: list of Plane
# ---------- c_script_5: C# ----------
    var booleans = BooleanMeshes(WindowLength, WindowHight, Planes, Meshs);

    A = booleans;
# ---------- c_script_5: C# additional code ----------
  public static Mesh[] BooleanMeshes(double winlength , double winhight,List<Plane> planes,List<Mesh> meshs,double depth=0.5)
  {
    var intx = new Interval(-0.5 * winlength, 0.5 * winlength);
    var inty = new Interval(-0.5 * winhight, 0.5 * winhight);
    var intz = new Interval(-0.5 * depth, 0.5 * depth);
    var boxlist = new List<Mesh>();
    foreach( var pl in planes)
    {
      var Window = new Box(pl, intx, inty, intz);
      var Windowm = Mesh.CreateFromBox(Window, 2, 2, 2);
      boxlist.Add(Windowm);
    }
    var result_meshes = Mesh.CreateBooleanDifference(meshs, boxlist);
    return result_meshes;

  }
# ---------- end c_script_5 ----------
mesh_9 = Mesh(c_script_5.A)
panel_36 = Panel(c_script_5.out)
preview_8 = CustomPreview(Geometry=mesh_9, Material=ColourSwatch(SwatchColor=RGB(222, 160, 27)))

# ----
item = ListItem(List=pt_11, Index=Slider(0, range=0..10), Wrap=True)
pt_12 = Point(Tree({0}: [Point(2.5, 12.5, 1.5), Point(7.5, 12.5, 1.5), Point(12.5, 12.5, 1.5), Point(17.5, 12.5, 1.5), Point(22.5, 12.5, 1.5)], {1}: [Point(2.5, 12.5, -1.5), Point(7.5, 12.5, -1.5), Point(12.5, 12.5, -1.5), Point(17.5, 12.5, -1.5), Point(22.5, 12.5, -1.5)], {2}: [Point(2.5, 7.5, 1.5), Point(7.5, 7.5, 1.5), Point(12.5, 7.5, 1.5), Point(17.5, 7.5, 1.5), Point(22.5, 7.5, 1.5), Point(27.5, 7.5, 1.5)], {3}: [Point(2.5, 7.5, -1.5), Point(7.5, 7.5, -1.5), Point(12.5, 7.5, -1.5), Point(17.5, 7.5, -1.5), Point(22.5, 7.5, -1.5)], {4}: [Point(2.5, 12.5000005, 4.5), Point(7.5, 12.5, 4.5), Point(12.5, 12.5, 4.5), Point(17.5, 12.5, 4.5), Point(22.5, 12.5, 4.5)], {5}: [Point(2.5, 7.500000503, 4.5), Point(7.5, 7.5, 4.5), Point(12.5, 7.5, 4.5), Point(17.5, 7.5, 4.5), Point(22.5, 7.5, 4.5), Point(27.5, 7.5, 4.5)]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))  # disabled
panel_37 = Panel(pt_12)  # disabled
pt_13 = Point(Tree({0}: [Point(12.5, 7.5, 1.5), Point(12.5, 12.5, 1.5), Point(12.5, 17.5, 1.5)], {1}: [Point(12.5, 7.5, -1.5), Point(12.5, 12.5, -1.5), Point(12.5, 17.5, -1.5)], {2}: [Point(7.5, 7.5, 1.5), Point(7.5, 12.5, 1.5), Point(7.5, 17.5, 1.5)], {3}: [Point(7.5, 7.5, -1.5), Point(7.5, 12.5, -1.5), Point(7.5, 17.5, -1.5)], {4}: [Point(12.5, -2.5, 4.5), Point(12.5, 2.5, 4.5), Point(12.5, 7.5, 4.5), Point(12.5, 12.5, 4.5), Point(12.5, 17.5, 4.5)], {5}: [Point(7.5, 2.5, 4.5), Point(7.5, 7.5, 4.5), Point(7.5, 12.5, 4.5), Point(7.5, 17.5, 4.5)]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))  # disabled

pline = PolyLine(Vertices=pt_12, Closed=False)  # disabled
pline_2 = PolyLine(Vertices=pt_13, Closed=False)  # disabled
pt_14 = Point([Point(12.5, 12.5, 1.5), Point(12.5, 12.5, -1.5), Point(12.5, 7.5, 1.5), Point(12.5, 7.5, -1.5), Point(7.5, 7.5, 1.5), Point(7.5, 7.5, -1.5)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])  # disabled
crv = Curve(Tree({0}: [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], {1}: [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], {2}: [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], {3}: [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], {4}: [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], {5}: [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], {6}: [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], {7}: [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], {8}: [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], {9}: [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], {10}: [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], {11}: [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]))  # disabled

# ---- group: structure
number_slider_8 = Slider(3, range=0..100)  # disabled
number_slider_9 = Slider(0.5, range=0..10)  # disabled
number_slider_10 = Slider(2.5, range=0..10)  # disabled
c_script_6 = CSharpScript(
    ipts=branch_5,
    index=number_slider_8,
    Modulex=number_slider_3,
    Moduley=number_slider_2,
    Modulez=number_slider_4,
    radius=number_slider_9)  # -> out, Columns, Beamx, Beamy, Joints, E, AxisX, AxisY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; inputs ipts: list of Point3d, index: Int32, Modulex: Double, Moduley: Double, Modulez: Double, findex: Int32, ifloors: Int32, radius: Double; disabled
# ---------- c_script_6: C# usings ----------
using System.Linq;
using Rhino.DocObjects.Tables;
using System.Drawing;
using Rhino.DocObjects;
# ---------- c_script_6: C# ----------
    //////creating joints
    var joints = new HashSet<Point3d>();
    var alljoints = makeAllColumnsJoints(ipts, Modulex, Moduley, Modulez);
    var templist = Flatten(alljoints);
    foreach(var pt in templist)
    {
      joints.Add(pt);
      joints.Add(new Point3d(pt.X, pt.Y, pt.Z - Modulez));
    }

    List<Point3d> listjoints = joints.ToList();
    listjoints = RemoveDuplicate(listjoints);

    ////////add columns

    //sorting vertical
    var vertclasslist = new List<VerticalPoints>();
    var checklist = new List<Point3d>();
    for ( int i = 0; i < listjoints.Count - 1; i++)

      if(!(intcheck(checklist, listjoints[i], "z")) || i == 0 )

      {
        var temp = new List<Point3d>();
        checklist.Add(listjoints[i]);
        temp.Add(listjoints[i]);
        for(int j = i + 1; j < listjoints.Count;j++)
        {
          if(vertcheck(listjoints[i], listjoints[j]))
          {
            temp.Add(listjoints[j]);
          }

        }
        var addclass = new VerticalPoints(temp, Modulez);
        vertclasslist.Add(addclass);
      }
      else
      {
        continue;
      }

    //sorting horizantalx
    var HorizXclasslist = new List<HorizentalPointsx>();
    var checklistx = new List<Point3d>();
    for ( int i = 0; i < listjoints.Count - 1; i++)

      if(!(intcheck(checklistx, listjoints[i], "x")) || i == 0 )

      {
        var temp = new List<Point3d>();
        checklistx.Add(listjoints[i]);
        temp.Add(listjoints[i]);
        for(int j = i + 1; j < listjoints.Count;j++)
        {
          if(horizcheckX(listjoints[i], listjoints[j]))
          {
            temp.Add(listjoints[j]);
          }

        }
        var addclass = new HorizentalPointsx(temp);
        HorizXclasslist.Add(addclass);
      }
      else
      {
        continue;
      }

    //sorting horizentalY
    var HorizYclasslist = new List<HorizentalPointsy>();
    var checklisty = new List<Point3d>();
    for ( int i = 0; i < listjoints.Count - 1; i++)

      if(!(intcheck(checklisty, listjoints[i], "y")) || i == 0 )

      {
        var temp = new List<Point3d>();
        checklisty.Add(listjoints[i]);
        temp.Add(listjoints[i]);
        for(int j = i + 1; j < listjoints.Count;j++)
        {
          if(horizcheckY(listjoints[i], listjoints[j]))
          {
            temp.Add(listjoints[j]);
          }

        }
        var addclass = new HorizentalPointsy(temp);
        addclass.Sort();
        HorizYclasslist.Add(addclass);
      }
      else
      {
        continue;
      }


    ////////////outputing horizx
    var OutPuttreehorizx = new DataTree<Point3d>();
    for(int i = 0; i < HorizXclasslist.Count;i++)
    {
      for(int j = 0 ; j < HorizXclasslist[i].horizpts.Count ; j++)
      {
        OutPuttreehorizx.Add(HorizXclasslist[i].horizpts[j], new GH_Path(i));

      }
    }
    var OutPuttreehorizy = new DataTree<Point3d>();
    for(int i = 0; i < HorizYclasslist.Count;i++)
    {
      for(int j = 0 ; j < HorizYclasslist[i].horizpts.Count ; j++)
      {
        OutPuttreehorizy.Add(HorizYclasslist[i].horizpts[j], new GH_Path(i));

      }
    }
    var OutPuttreevert = new DataTree<Point3d>();
    for(int i = 0; i < vertclasslist.Count;i++)
    {
      for(int j = 0 ; j < vertclasslist[i].vertpts.Count ; j++)
      {
        OutPuttreevert.Add(vertclasslist[i].vertpts[j], new GH_Path(i));

      }
    }
    /////// building floor beams
    var flooors = new Floors();
    for (double i = -Modulez / 2; i <= 6 * Modulez; i += Modulez)
    { //var ptz = vertclasslist[0];
      var it = 0;
      var fl = new Floor(it);
      foreach( var x in HorizYclasslist)
      {
        var temp = x.horizpts[0];
        if(Math.Abs(temp.Z - i) < 0.1)
        {
          fl.Add(x);
        }
      }
      foreach( var y in HorizXclasslist)
      {
        var temp = y.horizpts[0];
        if(Math.Abs(temp.Z - i) < 0.1)
        {
          fl.Add(y);

        }
      }
      flooors.Add(fl);
      it++;



    }
    Circlex = flooors.AnnotationCrclx(5, radius);
    Circley = flooors.AnnotationCrcly(5, radius);

    Columns = OutPuttreevert;
    Beamx = OutPuttreehorizx;
    Beamy = OutPuttreehorizy;
    Joints = listjoints;
    E = flooors.allfloors[0].XAxis;
    AxisX = flooors.XAxisLines(5);
    AxisY = flooors.YAxisLines(5);

    B = flooors.YAxisPts();
# ---------- c_script_6: C# additional code ----------
  public static List<Point3d> RemoveDuplicate(List<Point3d> pts)
  {
    for(int i = 0; i < pts.Count; i++)
    {
      for(int j = pts.Count - 1 ; j > i ;j--)
      {
        if (DistanceBetweenPoints(pts[i], pts[j]) < 0.1)
        {
          pts.RemoveAt(j);
        }
      }
    }
    return pts;

  }
  public static double DistanceBetweenPoints (Point3d a, Point3d b)
  {
    var dx = a.X - b.X;
    var dy = a.Y - b.Y;
    var dz = a.Z - b.Z;
    // calculate the distance
    var distance = Math.Sqrt(dx * dx + dy * dy + dz * dz);
    return distance ;
  }
  public List<Point3d> Flatten(List<List<Point3d>> list)
  {var listflatten = new List<Point3d>();
    for(int i = 0 ; i < list.Count; i++)
    {
      for (int j = 0 ; j < list[i].Count;j++)
      {
        listflatten.Add(list[i][j]);
      }
    }
    return listflatten;
  }
  public List<Line> makeAllColumnsLines (List<List<Point3d>> joints, double z)
  {
    var ptstop = joints[joints.Count - 1];
    var lines = new List<Line>();
    foreach (var p in ptstop)
    {
      var temp = new Point3d(p.X, p.Y, -1 * z / 2);
      lines.Add(new Line(p, temp));
    }
    return lines;
  }
  public List<List<Point3d>> makeAllColumnsJoints (List<Point3d> pts, double x, double y, double z)
  {var list = new List<List<Point3d>>();
    foreach (var pt in pts)
    {
      list.Add(JointMaker(pt, x, y, z));
    }
    return list;
  }
  public List<Point3d> JointMaker(Point3d pt, double x, double y, double z)
  {var vectorLenght = Math.Sqrt(((x * x) + (y * y)) / 4);
    var vectorDirection1 = (Vector3d.XAxis + Vector3d.YAxis);
    vectorDirection1.Unitize();
    var vectorDirection2 = (Vector3d.XAxis + (-1 * Vector3d.YAxis));
    vectorDirection2.Unitize();
    var movevector1 = (vectorLenght * vectorDirection1) + new Vector3d(0, 0, z / 2);
    var movevector2 = vectorLenght * vectorDirection2 + new Vector3d(0, 0, z / 2);
    var movevector3 = -1 * vectorLenght * vectorDirection1 + new Vector3d(0, 0, z / 2);
    var movevector4 = -1 * vectorLenght * vectorDirection2 + new Vector3d(0, 0, z / 2);
    ///////////////
    var pt1 = pt + movevector1;
    var point1 = new Point3d(pt1);
    var pt2 = pt + movevector2;
    var point2 = new Point3d(pt2);
    var pt3 = pt + movevector3;
    var point3 = new Point3d(pt3);
    var pt4 = pt + movevector4;
    var point4 = new Point3d(pt4);
    /////
    var ptlist = new List<Point3d>(){point1,point2 ,point3,point4};
    return  ptlist;
  }


  public bool intcheck(List<Point3d> intlist, Point3d check, string direction)
  {
    switch(direction)
    {
      case("z"):
        for (int i = 0; i < intlist.Count;i++)
        {
          if(vertcheck(intlist[i], check))
          {
            return true;
          }
        }
        return false;

      case("x"):
        for (int i = 0; i < intlist.Count;i++)
        {
          if(horizcheckX(intlist[i], check))
          {
            return true;
          }
        }
        return false;

      case("y"):
        for (int i = 0; i < intlist.Count;i++)
        {
          if(horizcheckY(intlist[i], check))
          {
            return true;
          }
        }
        return false;
      default:
        return false;

    }
    //return switch;

  }


  public bool vertcheck(Point3d pt1, Point3d pt2)
  {
    if ( Math.Abs(pt1.X - pt2.X) < 0.2 && Math.Abs(pt1.Y - pt2.Y) < 0.2)
    {
      return true;
    }
    return false;
  }
  public bool horizcheckX(Point3d pt1, Point3d pt2)
  {
    if ( Math.Abs(pt1.Z - pt2.Z) < 0.2 && Math.Abs(pt1.Y - pt2.Y) < 0.2)
    {
      return true;
    }
    return false;

  }
  public bool horizcheckY(Point3d pt1, Point3d pt2)
  {
    if ( Math.Abs(pt1.Z - pt2.Z) < 0.2 && Math.Abs(pt1.X - pt2.X) < 0.2)
    {
      return true;
    }
    return false;

  }

  public class VerticalPoints
  {
    public List<Point3d> vertpts {get;set;}
    public double Modulez {get;set;}

    public VerticalPoints(List<Point3d> pts, double z)
    {
      this.vertpts = pts;
      this.Sort();
      this.CreateColumns(z);
    }

    public void Sort()
    {
      List<Point3d> newList = vertpts.OrderBy(o => o.Z).ToList();
      vertpts = newList;

    }

    public void CreateColumns(double z)
    {
      var listcolumn = new List<Line>();
      var earth = vertpts[vertpts.Count - 1];
      var point = new Point3d(earth.X, earth.Y, -z / 2);
      if( DistanceBetweenPoints(point, vertpts[0]) > 0.01)
      {
        vertpts.Insert(0, point);
      }

    }

  }

  public class HorizentalPointsx
  {
    public List<Point3d> horizpts {get;set;}

    public HorizentalPointsx(List<Point3d> pts)
    {
      this.horizpts = pts;
      this.Sort();
    }
    public void Sort()
    {
      List<Point3d> newList = horizpts.OrderBy(o => o.X).ToList();
      horizpts = newList;

    }
  }
  public class HorizentalPointsy
  {
    public List<Point3d> horizpts {get;set;}

    public HorizentalPointsy(List<Point3d> pts)
    {
      this.horizpts = pts;
      this.Sort();
    }
    public void Sort()
    {
      List<Point3d> newList = horizpts.OrderBy(o => o.Y).ToList();
      horizpts = newList;

    }
  }

  public class Floor
  {
    public List<HorizentalPointsy>  YAxis {get;set;}
    public List<HorizentalPointsx>  XAxis {get;set;}
    public int floorindex {get;set;}
    public Floor(int floornum)
    {
      this.floorindex = floornum;
      YAxis = new List<HorizentalPointsy> ();
      XAxis = new List<HorizentalPointsx> ();

    }
    public void Add(HorizentalPointsx x)
    {
      XAxis.Add(x);
    }
    public void Add(HorizentalPointsy y)
    {
      YAxis.Add(y);
    }

  }
  public class Floors
  {
    public List<Floor> allfloors {get;set;}

    public Floors()
    {
      this.allfloors = new List<Floor>();
    }
    public void Add(Floor f)
    {
      allfloors.Add(f);
    }
    public double MaxX()
    { double max = 0;
      foreach(var flr in allfloors)
      {
        var temp = flr.XAxis;
        foreach (var r in temp)
        {
          var temp1 = r.horizpts;
          foreach(var pt in temp1)
          {
            if(pt.X > max)
            {
              max = pt.X;
            }
          }
        }
      }
      return max;
    }
    public double MinX()
    { double min = 500000;
      foreach(var flr in allfloors)
      {
        var temp = flr.XAxis;
        foreach (var r in temp)
        {
          var temp1 = r.horizpts;
          foreach(var pt in temp1)
          {
            if(pt.X < min)
            {
              min = pt.X;
            }
          }
        }
      }
      return min;
    }
    public double MaxY()
    { double max = 0;
      foreach(var flr in allfloors)
      {
        var temp = flr.YAxis;
        foreach (var r in temp)
        {
          var temp1 = r.horizpts;
          var pt = temp1[temp1.Count - 1];
          if(pt.Y > max)
          {
            max = pt.Y;
          }
        }
      }
      return max;
    }
    public double MinY()
    { double min = 500000;
      foreach(var flr in allfloors)
      {
        var temp = flr.YAxis;
        foreach (var r in temp)
        {
          var temp1 = r.horizpts;
          var pt = temp1[0];
          if(pt.Y < min)
          {
            min = pt.Y;
          }
        }
      }
      return min;
    }
    public List<Point3d> XAxisPts()
    { var listptx = new List<Point3d>();
      foreach(var flr in allfloors)
      {
        var temp = flr.YAxis;
        foreach (var r in temp)
        {
          var temp1 = r.horizpts;
          var pt = temp1[0];
          listptx.Add(new Point3d(pt.X, MinY(), 0));

        }
      }
      listptx = RemoveDuplicate(listptx);
      listptx = listptx.OrderBy(o => o.X).ToList();
      return listptx;


    }

    public List<Point3d> YAxisPts()
    { var listpty = new List<Point3d>();
      var min = MinX();
      foreach(var flr in allfloors)
      {
        var temp = flr.XAxis;
        foreach (var r in temp)
        {
          var temp1 = r.horizpts;
          var pt = temp1[0];
          listpty.Add(new Point3d(min, pt.Y, 0));

        }
      }
      listpty = RemoveDuplicate(listpty);
      listpty = listpty.OrderBy(o => o.Y).ToList();
      return listpty;
    }
    public List<Line> XAxisLines(double extend)
    { var listline = new List<Line>();
      var start = XAxisPts();
      //start = start.OrderBy(o => o.X).ToList();
      foreach (var pt in start)
      { var ptstart = pt + new Point3d(0, -1 * extend, 0);
        var ln = new Line(ptstart, Vector3d.YAxis, Math.Abs(MaxY() - MinY()) + 2 * extend);
        listline.Add(ln);
      }
      return listline;

    }
    public List<Line> YAxisLines(double extend)
    { var listline = new List<Line>();
      var start = YAxisPts();
      //start = start.OrderBy(o => o.Y).ToList();
      foreach (var pt in start)
      { var ptstart = pt + new Point3d(-1 * extend, 0, 0);
        var ln = new Line(ptstart, Vector3d.XAxis, Math.Abs(MaxX() - MinX()) + 2 * extend);
        listline.Add(ln);
      }
      return listline;

    }
    public List<Circle> AnnotationCrclx(double Modulez, double radius)
    { var circles = new List<Circle>();
      var lns = XAxisLines(Modulez);
      var ptc = new Point3d(0, -1 * radius, 0);
      foreach(var l in lns)
      {
        var pts = l.PointAt(0);
        Point3d ptrscenter = pts + ptc;
        circles.Add(new Circle(ptrscenter, radius));
      }
      return circles;

    }
    public List<Circle> AnnotationCrcly(double Modulez, double radius)
    { var circles = new List<Circle>();
      var lns = YAxisLines(Modulez);
      var ptc = new Point3d(-1 * radius, 0, 0);
      foreach(var l in lns)
      {
        var pts = l.PointAt(0);
        Point3d ptrscenter = pts + ptc;
        circles.Add(new Circle(ptrscenter, radius));
      }
      return circles;

    }








  }
# ---------- end c_script_6 ----------
division = Division(A=number_slider_9, B=number_slider_10)  # disabled
circle = Circle(c_script_6.Circley)  # disabled
circle_2 = Circle(c_script_6.Circlex)  # disabled
panel_38 = Panel(c_script_6.out)  # disabled
number_slider_11 = Slider(2, range=0..10)  # disabled
points_4 = PointList(Points=c_script_6.Beamy, Size=number_slider_11)  # disabled
number_slider_12 = Slider(1, range=0..10)  # disabled
number_slider_13 = Slider(1, range=0..1)  # disabled
number_slider_14 = Slider(90, range=0..100)  # disabled
division_2 = Division(A=number_slider_9, B=number_slider_12)  # disabled

lng = ListLength(List=c_script_6.AxisY)  # disabled
panel_39 = Panel("""A
B
C
D
E
F
G
H
I
J
K
L
M
N
O
P
Q
R
S
T
U
V
W
X
Y
Z""")  # disabled
split = SplitList(List=panel_39, Index=lng)  # -> ListA, ListB; disabled
panel_40 = Panel(split.ListA)  # disabled

# ---- group: structure / dash dot
number_slider_15 = Slider(0.3, range=0..1)  # disabled
number_slider_16 = Slider(0.1, range=0..1)  # disabled
dash = DashPattern(Curve=[c_script_6.AxisX, c_script_6.AxisY], Pattern=[number_slider_15, number_slider_16])  # -> Dashes, Gaps; disabled
number_slider_17 = Slider(0.01, range=0..0.01)  # disabled
midpt = CurveMiddle(Curve=dash.Gaps)  # disabled
cir_2 = Circle(Plane=midpt, Radius=number_slider_17)  # disabled

# ---- group: structure
number_slider_18 = Slider(90, range=0..100)  # disabled
pt_15 = Point(c_script_6.Circlex)  # disabled
xy = XYPlane(Origin=pt_15)  # disabled
rotate = Rotate(Geometry=xy, Angle=degrees(number_slider_18), Plane=xy)  # -> Geometry, Transform; disabled

X = UnitX(Factor=division)  # disabled
Y = UnitY(Factor=division)  # disabled
neg = Negative(Value=X)  # disabled
addition = Addition(A=neg, B=Y)  # disabled
neg_2 = Negative(Value=addition)  # disabled
move = Move(Geometry=rotate.Geometry, Motion=neg_2)  # -> Geometry, Transform; disabled

pt_16 = Point(c_script_6.Circley)  # disabled
xy_2 = XYPlane(Origin=pt_16)  # disabled
rotate_2 = Rotate(Geometry=xy_2, Angle=degrees(number_slider_14), Plane=xy_2)  # -> Geometry, Transform; disabled

X_2 = UnitX(Factor=division)  # disabled
Y_2 = UnitY(Factor=division)  # disabled
neg_3 = Negative(Value=X_2)  # disabled
addition_2 = Addition(A=neg_3, B=Y_2)  # disabled
neg_4 = Negative(Value=addition_2)  # disabled
move_2 = Move(Geometry=rotate_2.Geometry, Motion=neg_4)  # -> Geometry, Transform; disabled

lng_2 = ListLength(List=c_script_6.AxisX)  # disabled
series = Series(Start=number_slider_13, Step=1, Count=lng_2)  # disabled

tag = TextTag3D(Location=move.Geometry, Text=series, Size=division_2, Justification=7)  # disabled
# https://stackoverflow.com/questions/16620135/sort-a-list-of-objects-by-the-value-of-a-property/16620159
# 
# 
# https://stackoverflow.com/questions/3309188/how-to-sort-a-listt-by-a-property-in-the-object
tag_2 = TextTag3D(Location=move_2.Geometry, Text=split.ListA, Size=division_2, Justification=7)  # disabled

# ----
number_slider_19 = Slider(6, range=0..10)  # disabled
explode = Explode(Curve=crv, Recursive=True)  # -> Segments, Vertices; disabled
explode_2 = Explode(Curve=pline, Recursive=True)  # -> Segments, Vertices; disabled
explode_3 = Explode(Curve=pline_2, Recursive=True)  # -> Segments, Vertices; disabled
end = EndPoints(Curve=crv)  # -> Start, End; disabled
number_slider_20 = Slider(0.1, range=0..0.1)  # disabled
merge_2 = Merge(Data1=explode.Segments, Data2=explode_2.Segments, Data3=explode_3.Segments)  # -> flatten(Result); disabled
merge_3 = Merge(Data1=explode_2.Segments, Data2=explode_3.Segments)  # -> flatten(Result); disabled
list = ValueList({"m": 0, "dm": 1, "cm": 2, "mm": 3}, selected="cm")  # disabled
pt_17 = Point(end.End)  # disabled
merge_4 = Merge(Data1=pt_14, Data2=pt_17)  # -> flatten(Result); disabled
mat = Material(Name="Steel", Type="LIN_ELAST_ISOTROPIC", YoungsModulus=200000, AlphaT=0, Nue=0, Density=78.5, Strength=235000)  # disabled
crvref = CurveRefinement(PDeg=3, ElementRefU=number_slider_19, IsKnotApproxElementSize=False, IsKnotSubdivision=True)  # disabled
profile = SectionFromProfile(Unit=list)  # -> Section, SectionTable; disabled
box = BoxSection(Height=0.2, Width=0.1, Thickness=0)  # -> Section, Area; disabled
lina = LinearAnalysis(Name="MyAnalysis")  # disabled
beam = BeamElement(C=merge_2, M=mat, S=box.Section, R=crvref, HS=False, HE=False, HB=False)  # disabled
number_slider_21 = Slider(0.3, range=0..1)  # disabled
number_slider_22 = Slider(0.01, range=0..0.1)  # disabled
list_2 = ValueList({"DEAD": 1, "SNOW": 2, "PRES": 3, "PRES_FL": 4, "MOMENT": 5}, selected="DEAD")  # disabled
crvload = CurveLoad(Crv=merge_3, Loadtype=list_2, Direction=Vector(0, 0, -1), Value=number_slider_22, LoadCase=1)  # disabled
button = Button()  # disabled
number_slider_23 = Slider(0.06, range=0..0.1)  # disabled
number_slider_24 = Slider(5, range=0..10)  # disabled
number_slider_25 = Slider(0.001, range=0..0.001)  # disabled
number_slider_26 = Slider(0.0001, range=0..0.0001)  # disabled
list_3 = ValueList({"N": 1, "M1": 2, "M2": 3, "Mt": 4, "V1": 5, "V2": 6, "N stress": 7, "Shear stress 1": 8, "Shear stress 2": 9, "v Mises stress": 10, "Utilization (v Mises)": 11, "Cross Section": 12}, selected="N")  # disabled
Z_2 = UnitZ(Factor=1)  # disabled
Y_3 = UnitY(Factor=1)  # disabled

duppt = RemoveDuplicatePts(Points=merge_4, Tolerance=number_slider_20)  # disabled

suppt = SupportPoint(Point=duppt, DispX=True, DispY=True, DispZ=True, Rotation=False, Torsion=False)  # disabled
amodel = AnalysisModel(
    Analysis=lina,
    StructuralElements=beam,
    Supports=suppt,
    Loads=crvload,
    IntersectionTolerance=0.01,
    IsCarat=True,
    IsKratos=False,
    PenaltyFac=10000000,
    ShowCouplingIDs=False,
    ShowEdgeIDs=False,
    ShowGeo=True,
    ShowPatchIDs=True,
    ShowPrePro=True,
    ShowRef=False)  # disabled
run_analysis = IGASolver(AnalysisModel=amodel, Run=button, antiFreeze=False, showWindow=True)  # -> ResultModel, ErrorReport; disabled
supportforces = SupportForces(Model=run_analysis.ResultModel, Type=1, ScaleFactor=number_slider_25)  # -> flatten(Force), Location; disabled
defmod = DeformedModel(Model=run_analysis.ResultModel, ScaleFactor=number_slider_25, FlyingNodeLimit=100000)  # -> Model, Geo, DeformedStructuralElements; disabled
_1dresview = _1DElementResultView(Model=run_analysis.ResultModel, Type=list_3, ScaleFactor=number_slider_26, Direction=Z_2, ShowColourPlot=True)  # -> Results, ResultList, Mesh, LegendC, LegendT; disabled
panel_41 = Panel(supportforces.Force)  # disabled
legend = Legend(Colour=_1dresview.LegendC, Tags=_1dresview.LegendT, LegendType=1)  # disabled
