# Grasshopper definition privacy-alpha generator-gh.gh (Grasshopper 1.0.7)

number_slider = Slider(5, range=0..10)
number_slider_2 = Slider(5, range=0..10)
number_slider_3 = Slider(3, range=0..10)

number_slider_4 = Slider(6.4, range=0..20)
md_slider = MDSlider(
    SliderMode=0,
    slider_value=Point(0.5397581537, 0.4746837616, 0.5),
    x_domain=Domain(0, 1),
    y_domain=Domain(0, 1),
    z_domain=Domain(0, 1))
md_slider_2 = MDSlider(
    SliderMode=0,
    slider_value=Point(0.6320080125, 0.5485172272, 0.5),
    x_domain=Domain(0, 1),
    y_domain=Domain(0, 1),
    z_domain=Domain(0, 1))
galapagos = Galapagos(fitness=expression, gene=number_slider_4)

pt = ConstructPoint(XCoordinate=number_slider_4, YCoordinate=Slider(9, range=0..100), ZCoordinate=Slider(0, range=-6..6))
pl = ConstructPlane(Origin=pt, XAxis=Vector(1, 0, 0), YAxis=Vector(0, 1, 0))
box = DomainBox(Base=pl, X=number_slider, Y=number_slider_2, Z=number_slider_3)
box_2 = DomainBox(Base=PlaneXY(0, 0, 0), X=number_slider, Y=number_slider_2, Z=number_slider_3)
debrep = DeconstructBrep(Brep=box)  # -> Faces, Edges, Vertices
debrep_2 = DeconstructBrep(Brep=box_2)  # -> flatten(Faces), Edges, Vertices

item = ListItem(List=debrep.Faces, Index=Slider(0, range=0..10), Wrap=True)
debrep_3 = DeconstructBrep(Brep=item)  # -> Faces, flatten(Edges), Vertices
area = Area(Geometry=item)  # -> Area, Centroid
item_2 = ListItem(List=debrep_3.Edges, Index=0, Wrap=True)  # -> Item, Item1, Item2
c_script = CSharpScript(winx=Slider(3, range=0..10), xlength=number_slider, winz=Slider(1.5, range=0..10), zlength=number_slider_3)  # -> out, scalex, scaley, limitx, limitz; inputs winx: Double, xlength: Double, winz: Double, zlength: Double
# ---------- c_script: C# ----------
    scalex = winx / xlength;
    scaley = winz / zlength;

    
   
    limitx = (xlength - winx) / xlength;
    limitz = (zlength - winz) / zlength;
# ---------- c_script: C# additional code ----------
  public static double Normalize(double x, double max)
  {
    return (x / max);
  }
# ---------- end c_script ----------
pl_2 = ConstructPlane(Origin=area.Centroid, XAxis=item_2.Item, YAxis=item_2.Item2)
scale_nu = ScaleNU(Geometry=item, Plane=pl_2, ScaleX=c_script.limitx, ScaleY=c_script.limitz, ScaleZ=1)  # -> Geometry, Transform
scale_nu_2 = ScaleNU(Geometry=item, Plane=pl_2, ScaleX=c_script.scalex, ScaleY=c_script.scaley, ScaleZ=1)  # -> Geometry, Transform
area_2 = Area(Geometry=scale_nu_2.Geometry)  # -> Area, Centroid
evalsrf = EvaluateSurface(Surface=reparameterize(scale_nu.Geometry), Point=md_slider_2)  # -> Point, Normal, UDirection, VDirection, Frame
vec2pt = Vector2Pt(PointA=area_2.Centroid, PointB=evalsrf.Point, Unitize=False)  # -> Vector, Length
move = Move(Geometry=scale_nu_2.Geometry, Motion=vec2pt.Vector)  # -> Geometry, Transform
debrep_4 = DeconstructBrep(Brep=move.Geometry)  # -> Faces, Edges, Vertices

item_3 = ListItem(List=debrep_2.Faces, Index=Slider(2, range=0..10), Wrap=True)
debrep_5 = DeconstructBrep(Brep=item_3)  # -> Faces, flatten(Edges), Vertices
area_3 = Area(Geometry=item_3)  # -> Area, Centroid
item_4 = ListItem(List=debrep_5.Edges, Index=0, Wrap=True)  # -> Item, Item1, Item2
c_script_2 = CSharpScript(winx=Slider(3, range=0..10), xlength=number_slider, winz=Slider(1.5, range=0..10), zlength=number_slider_3)  # -> out, scalex, scaley, limitx, limitz; inputs winx: Double, xlength: Double, winz: Double, zlength: Double; same code as c_script
pl_3 = ConstructPlane(Origin=area_3.Centroid, XAxis=item_4.Item, YAxis=item_4.Item2)
scale_nu_3 = ScaleNU(Geometry=item_3, Plane=pl_3, ScaleX=c_script_2.limitx, ScaleY=c_script_2.limitz, ScaleZ=1)  # -> Geometry, Transform
scale_nu_4 = ScaleNU(Geometry=item_3, Plane=pl_3, ScaleX=c_script_2.scalex, ScaleY=c_script_2.scaley, ScaleZ=1)  # -> Geometry, Transform
area_4 = Area(Geometry=scale_nu_4.Geometry)  # -> Area, Centroid
evalsrf_2 = EvaluateSurface(Surface=reparameterize(scale_nu_3.Geometry), Point=md_slider)  # -> Point, Normal, UDirection, VDirection, Frame
vec2pt_2 = Vector2Pt(PointA=area_4.Centroid, PointB=evalsrf_2.Point, Unitize=False)  # -> Vector, Length
move_2 = Move(Geometry=scale_nu_4.Geometry, Motion=vec2pt_2.Vector)  # -> Geometry, Transform
debrep_6 = DeconstructBrep(Brep=move_2.Geometry)  # -> Faces, Edges, Vertices

Y = UnitY(Factor=1)
vec2pt_3 = Vector2Pt(PointA=area_4.Centroid, PointB=area_2.Centroid, Unitize=True)  # -> Vector, Length
angle = Angle(VectorA=Y, VectorB=vec2pt_3.Vector)  # -> Angle, Reflex
deg = Degrees(Radians=angle.Angle)

the_angle = Panel(deg)

item_5 = ListItem(List=debrep_4.Vertices, Index=0, Wrap=True)  # -> Item, Item1, Item2, Item3
item_6 = ListItem(List=debrep_6.Vertices, Index=0, Wrap=True)  # -> Item, Item1, Item2, Item3
pt_2 = Point(item_6.Item3)
pt_3 = Point(item_5.Item)
pt_4 = Point(item_6.Item)
pt_5 = Point(item_6.Item1)
pt_6 = Point(item_6.Item2)
pt_7 = Point(item_5.Item1)
pt_8 = Point(item_5.Item2)
pt_9 = Point(item_5.Item3)
ln = Line(StartPoint=pt_6, EndPoint=pt_3)
ln_2 = Line(StartPoint=pt_2, EndPoint=pt_7)
ln_3 = Line(StartPoint=pt_4, EndPoint=pt_8)
ln_4 = Line(StartPoint=pt_5, EndPoint=pt_9)

merge = Merge(Data1=ln, Data2=ln_2, Data3=ln_3, Data4=ln_4)
multiplication = Multiplication(A=number_slider, B=number_slider_2)
ext = ExtendCurve(Curve=flatten(merge), Type=0, Start=Slider(0, range=0..100), End=multiplication)
split = SplitWithBrep(Curve=ext, Brep=box)  # -> Curve, flatten(Points)
item_7 = ListItem(List=split.Curve, Index=Slider(2, range=0..10), Wrap=True)
item_8 = ListItem(List=split.Curve, Index=Slider(1, range=0..10), Wrap=True)
crv = Curve(item_8)
item_9 = ListItem(List=flatten(crv), Index=0, Wrap=True)  # -> Item, Item1, Item2, Item3
midpt = CurveMiddle(Curve=[item_9.Item, item_9.Item1, item_9.Item2, item_9.Item3])
lnln = LineLine(LineA=item_9.Item1, LineB=item_9.Item3)
lnln_2 = LineLine(LineA=item_9.Item, LineB=item_9.Item2)
lnln_3 = LineLine(LineA=item_9.Item, LineB=item_9.Item1)
lnln_4 = LineLine(LineA=item_9.Item2, LineB=item_9.Item3)

volume = Volume(Geometry=box_2)  # -> Volume, Centroid

sec = BrepPlane(Brep=box, Plane=[lnln_2, lnln, lnln_3, lnln_4])  # -> Curves, Points
boundary = BoundarySurfaces(Edges=sec.Curves)
avr = Average(Input=midpt)
item_10 = ListItem(List=flatten(boundary), Index=0, Wrap=True)  # -> Item, Item1, Item2, Item3
split_2 = SplitBrep(Brep=box, Cutter=item_10.Item)
capex = CapHolesEx(Brep=split_2)  # -> Brep, Caps, Solid
brepinc = PointInBrep(Brep=capex.Brep, Point=avr, Strict=False)
cull = CullPattern(List=capex.Brep, CullPattern=brepinc)
split_3 = SplitBrep(Brep=cull, Cutter=item_10.Item1)
capex_2 = CapHolesEx(Brep=split_3)  # -> Brep, Caps, Solid
brepinc_2 = PointInBrep(Brep=capex_2.Brep, Point=avr, Strict=invert(False))
cull_2 = CullPattern(List=capex_2.Brep, CullPattern=brepinc_2)
split_4 = SplitBrep(Brep=cull_2, Cutter=item_10.Item2)
capex_3 = CapHolesEx(Brep=split_4)  # -> Brep, Caps, Solid
brepinc_3 = PointInBrep(Brep=capex_3.Brep, Point=avr, Strict=invert(False))
cull_3 = CullPattern(List=capex_3.Brep, CullPattern=brepinc_3)
split_5 = SplitBrep(Brep=cull_3, Cutter=item_10.Item3)
capex_4 = CapHolesEx(Brep=split_5)  # -> Brep, Caps, Solid
brepinc_4 = PointInBrep(Brep=capex_4.Brep, Point=avr, Strict=invert(False))
cull_4 = CullPattern(List=capex_4.Brep, CullPattern=brepinc_4)
brep = Brep(cull_4)
Z = UnitZ(Factor=Slider(5, range=0..10))

move_3 = Move(Geometry=brep, Motion=Z)  # -> Geometry, Transform
volume_2 = Volume(Geometry=move_3.Geometry)  # -> Volume, Centroid

observable_volume = Panel(volume_2.Volume)

expression = Expression(x=volume_2.Volume, y=volume.Volume, Expression="(x/y)*100")

volume_percentage = Panel(expression)
